# Grasshopper definition BranchNodeRnd_2.gh (Grasshopper 1.0.7)
# Spherical spikey thing

branch_length = Slider(10, range=0..10)
cell_radius = Slider(10, range=0..10)
count = GetNumber(
    Slider(100, range=1..100),
    AtLeast=1,
    AtMost=2147483647,
    Maximum=1.797693135e+308,
    Minimum=-1.797693135e+308,
    TreeAccess=False)
radius = GetNumber(cell_radius, AtLeast=1, AtMost=2147483647, Maximum=1.797693135e+308, Minimum=-1.797693135e+308, TreeAccess=False)
length = GetNumber(branch_length, AtLeast=1, AtMost=2147483647, Maximum=1.797693135e+308, Minimum=-1.797693135e+308, TreeAccess=False)
construct_point = ConstructPoint(XCoordinate=0, YCoordinate=0, ZCoordinate=0)
mesh_sphere = MeshSphere(Base=construct_point, Radius=radius, UCount=10, VCount=20)
populate_geometry = PopulateGeometry(Geometry=mesh_sphere, Count=count, Seed=1)
facet_dome = FacetDome(Points=populate_geometry, Radius=radius)  # -> Pattern, Dome
explode = Explode(Curve=facet_dome.Pattern, Recursive=True)  # -> Segments, Vertices
point_on_curve = PointOnCurve(explode.Segments, parameter=0.5)
average = Average(Input=point_on_curve)
list_length = ListLength(List=explode.Segments)
vector_2pt = Vector2Pt(PointA=construct_point, PointB=average, Unitize=invert(False))  # -> Vector, Length
amplitude = Amplitude(Vector=vector_2pt.Vector, Amplitude=length)
addition = Addition(A=average, B=amplitude)
end_points = EndPoints(Curve=graft(explode.Segments))  # -> Start, End
duplicate_data = DuplicateData(Data=addition, Number=list_length, Order=True)
shift_paths = ShiftPaths(Data=duplicate_data, Offset=-1)  # -> graft(Data)
mesh_triangle = MeshTriangle(CornerA=0, CornerB=1, CornerC=2)
merge = Merge(Data1=end_points.Start, Data2=end_points.End, Data3=shift_paths)
construct_mesh = ConstructMesh(Vertices=merge, Faces=mesh_triangle)
mesh_join = MeshJoin(Meshes=flatten(construct_mesh))
align_vertices = AlignVertices(Mesh=mesh_join, Tolerance=0.1)  # -> Result, Count
weld_mesh = WeldMesh(Mesh=align_vertices.Result, Angle=3.141592654)
subd_from_mesh = SubDFromMesh(Mesh=weld_mesh, Creases=1, Corners=1, Interpolate=False)
mesh_from_subd = MeshFromSubD(SubD=subd_from_mesh, Density=2)
deconstruct_mesh = DeconstructMesh(Mesh=mesh_from_subd)  # -> Vertices, Faces, Colours, Normals
mesh_colours = MeshColours(Mesh=mesh_from_subd, Colours=deconstruct_mesh.Normals)
custom_preview = CustomPreview(Geometry=mesh_from_subd, Material=ColourSwatch(SwatchColor=RGB(25, 112, 212)))
c_script = CSharpScript(mesh=mesh_colours)  # -> base64Draco; inputs mesh: Mesh
# ---------- c_script: C# ----------
    var options = new Rhino.FileIO.DracoCompressionOptions();
    options.CompressionLevel = 5;
    options.IncludeTextureCoordinates = false;
    options.IncludeVertexColors = true;

    var compressed = Rhino.FileIO.DracoCompression.Compress(mesh, options);
    base64Draco = compressed.ToBase64String();
# ---------- end c_script ----------
context_print = ContextPrint(MeshB64=c_script)
