# Grasshopper definition building.gh (Grasshopper 1.0.7)
# plug-ins: DeCodingSpaces, Bifocals

site_boundary = Curve(<curve referenced from the Rhino model>)
floor_area_ratio_far = Slider(3.4, range=0.5..7)
initial_streets = Curve([<curve referenced from the Rhino model> x8])
building_length = Slider(19, range=3..100)
building_depth = Slider(21, range=3..100)
floor_height = Slider(3, range=3..4.5)
side_setback = Slider(1, range=1..6)
back_setback = Slider(1, range=1..6)
min_length_of_street_segment = Slider(21, range=0..100)
max_length_of_street_segment = Slider(255, range=0..350)
range_of_angles_for_street = Slider(50, range=3..50)
depth_of_street_hierarchy = Slider(2, range=0..4)
max_plot_area = Slider(700, range=700..400000)
width = Slider(8, range=8..20)
min_plot_width = Slider(29, range=20..100)
road_face_setback = Slider(3, range=3..6)
max_arms_at_crossroads = Slider(4, range=4..10)
streetnetworksynthesist = StreetNetworkSynthesisT(
    Boundary=site_boundary,
    IniStreets=initial_streets,
    MinLength=min_length_of_street_segment,
    MaxLength=max_length_of_street_segment,
    MinDist=40,
    RandomAngle=range_of_angles_for_street,
    MaxArms=max_arms_at_crossroads,
    TreeDepth=depth_of_street_hierarchy)
geometry = Geometry(streetnetworksynthesist)
panel = Panel("MAIN STREET NETWORK")
division = Division(A=width, B=2)
site_division = PolygonsFromLines(Lines=geometry, MinBlockSize=0)  # -> Polygons, SynchronizedValues
offset_curve = Offset(Curve=site_division.Polygons, Distance=division, Plane=PlaneXY(0, 0, 0), Corners=1)  # -> flatten(Curve)
parcels = Parcels(Polygons=site_division.Polygons, MaxParcelArea=max_plot_area, ConnectionDistance=division, StreetOffset=min_plot_width)
curve_to_polyline = CurveToPolyline(Curve=offset_curve, ToleranceDistance=0, ToleranceAngle=0)  # -> Polyline, Segments
panel_2 = Panel("Blocks")
panel_3 = Panel("Plots")
plots = Geometry(parcels)
area = Area(Geometry=curve_to_polyline.Polyline)  # -> flatten(Area), Centroid
buildable_area = BuildableArea(
    Parcels=plots,
    Blocks=curve_to_polyline.Polyline,
    RoadSetback=road_face_setback,
    SideSetback=side_setback,
    BackSetback=back_setback,
    Tolerance=0.1)
area_2 = Area(Geometry=plots)  # -> flatten(Area), Centroid
mass_addition = MassAddition(Input=area.Area)  # -> Result, PartialResults
panel_4 = Panel("Building Footprint")
geometry_2 = Geometry(buildable_area)
building_generation = BuildingGeneration(
    BuildableArea=geometry_2,
    Parcels=plots,
    Blocks=curve_to_polyline.Polyline,
    BuildingDepth=building_depth,
    BuildingLength=building_length,
    BuildingType=0,
    Location=area_2.Centroid,
    FAR=floor_area_ratio_far,
    FloorHeight=floor_height)  # -> BuildingFootprint, flatten(NumberOfFloors), BuildingHeight, FAR, flatten(GFA)
gross_floor_area_gfa = Panel(building_generation.GFA)
number_of_floors = Panel(building_generation.NumberOfFloors)
building_heights = Panel(building_generation.BuildingHeight)
areas_of_individual_plots = Panel(area_2.Area)
curve = Curve(building_generation.BuildingFootprint)
mass_addition_2 = MassAddition(Input=building_generation.GFA)  # -> Result, PartialResults
unit_z = UnitZ(Factor=building_generation.BuildingHeight)
extrude = Extrude(Base=curve, Direction=unit_z)
panel_5 = Panel("Building Mass Configuration")
cap_holes = CapHoles(Brep=extrude)
total_gross_floor_area_gfa = Panel(mass_addition_2.Result)
total_sellable_land_area = Panel(mass_addition.Result)
