# Grasshopper definition final_building.gh (Grasshopper 1.0.7)
# plug-ins: DeCodingSpaces, Bifocals, Rhino.Inside for Autodesk Revit, Bowerbird2, Human, ElkGHComponents, LunchBox, RhinoCodePluginGH, Pufferfish

alternatives_for_commercial_space_distri = Slider(20, range=0..50)  # "Alternatives for Commercial Space distribution"
alternatives_for_amenity_space_distribut = Slider(19, range=0..50)  # "Alternatives for Amenity Space distribution"
alternatives_for_residential_space_distr = Slider(26, range=0..50)  # "Alternatives for Residential Space distribution"
open_space = Slider(20, range=20..100)
amenity_space = Slider(10, range=5..100)
alternatives_for_open_space_distribution = Slider(10, range=0..50)
commercial_buildings = Slider(30, range=0..100)
residential_buildings = Slider(35, range=0..100)
min_length_of_street_segment = Slider(21, range=0..100)
floor_area_ratio_far = Slider(3.4, range=0.5..7)
max_length_of_street_segment = Slider(255, range=0..350)
building_length = Slider(19, range=3..100)
building_depth = Slider(21, range=3..100)
floor_height = Slider(3, range=3..4.5)
side_setback = Slider(1, range=1..6)
back_setback = Slider(1, range=1..6)
max_plot_area = Slider(700, range=700..400000)
depth_of_street_hierarchy = Slider(2, range=0..4)
street_width = Slider(9, range=9..20)
site_boundary = Curve(<curve referenced from the Rhino model>)
initial_streets = Curve([<curve referenced from the Rhino model> x8])
min_plot_width = Slider(29, range=20..100)
road_face_setback = Slider(3, range=3..6)

panel = Panel("INPUTS")
calendar = Calendar()
alternatives_for_open_space_distribution_2 = GetNumber(
    alternatives_for_open_space_distribution,
    AtLeast=1,
    AtMost=1,
    Maximum=1.797693135e+308,
    Minimum=-1.797693135e+308,
    TreeAccess=False)
street_width_2 = GetNumber(street_width, AtLeast=1, AtMost=1, Maximum=1.797693135e+308, Minimum=-1.797693135e+308, TreeAccess=False)
min_plot_width_2 = GetNumber(min_plot_width, AtLeast=1, AtMost=1, Maximum=1.797693135e+308, Minimum=-1.797693135e+308, TreeAccess=False)
alternatives_for_commercial_space_distri_2 = GetNumber(
    alternatives_for_commercial_space_distri,
    AtLeast=1,
    AtMost=1,
    Maximum=1.797693135e+308,
    Minimum=-1.797693135e+308,
    TreeAccess=False)  # "Alternatives for commercial space distribution"
alternatives_for_amenity_space_distribut_2 = GetNumber(
    alternatives_for_amenity_space_distribut,
    AtLeast=1,
    AtMost=1,
    Maximum=1.797693135e+308,
    Minimum=-1.797693135e+308,
    TreeAccess=False)  # "Alternatives for Amenity space distribution"
building_depth_2 = GetNumber(building_depth, AtLeast=1, AtMost=1, Maximum=1.797693135e+308, Minimum=-1.797693135e+308, TreeAccess=False)
back_setback_2 = GetNumber(back_setback, AtLeast=1, AtMost=1, Maximum=1.797693135e+308, Minimum=-1.797693135e+308, TreeAccess=False)
commercial_buildings_2 = GetNumber(commercial_buildings, AtLeast=1, AtMost=1, Maximum=1.797693135e+308, Minimum=-1.797693135e+308, TreeAccess=False)
residential_buildings_2 = GetNumber(residential_buildings, AtLeast=1, AtMost=1, Maximum=1.797693135e+308, Minimum=-1.797693135e+308, TreeAccess=False)
side_setback_2 = GetNumber(side_setback, AtLeast=1, AtMost=1, Maximum=1.797693135e+308, Minimum=-1.797693135e+308, TreeAccess=False)
amenity_space_2 = GetNumber(amenity_space, AtLeast=1, AtMost=1, Maximum=1.797693135e+308, Minimum=-1.797693135e+308, TreeAccess=False)
min_length_of_street_segment_2 = GetNumber(min_length_of_street_segment, AtLeast=1, AtMost=1, Maximum=1.797693135e+308, Minimum=-1.797693135e+308, TreeAccess=False)
max_plot_area_2 = GetNumber(max_plot_area, AtLeast=1, AtMost=1, Maximum=1.797693135e+308, Minimum=-1.797693135e+308, TreeAccess=False)
road_face_setback_2 = GetNumber(road_face_setback, AtLeast=1, AtMost=1, Maximum=1.797693135e+308, Minimum=-1.797693135e+308, TreeAccess=False)
building_length_2 = GetNumber(building_length, AtLeast=1, AtMost=1, Maximum=1.797693135e+308, Minimum=-1.797693135e+308, TreeAccess=False)
max_length_of_street_segment_2 = GetNumber(max_length_of_street_segment, AtLeast=1, AtMost=1, Maximum=1.797693135e+308, Minimum=-1.797693135e+308, TreeAccess=False)
floor_area_ratio_far_2 = GetNumber(floor_area_ratio_far, AtLeast=1, AtMost=1, Maximum=1.797693135e+308, Minimum=-1.797693135e+308, TreeAccess=False)
floor_height_2 = GetNumber(floor_height, AtLeast=1, AtMost=1, Maximum=1.797693135e+308, Minimum=-1.797693135e+308, TreeAccess=False)
open_space_2 = GetNumber(open_space, AtLeast=1, AtMost=1, Maximum=1.797693135e+308, Minimum=-1.797693135e+308, TreeAccess=False)
depth_of_street_hierarchy_2 = GetNumber(depth_of_street_hierarchy, AtLeast=1, AtMost=1, Maximum=1.797693135e+308, Minimum=-1.797693135e+308, TreeAccess=False)
alternatives_for_residential_space_distr_2 = GetNumber(
    alternatives_for_residential_space_distr,
    AtLeast=1,
    AtMost=1,
    Maximum=1.797693135e+308,
    Minimum=-1.797693135e+308,
    TreeAccess=False)  # "Alternatives for residential space distribution"

from_hour = Slider(0, range=0..24)  # disabled
from_day = Slider(7, range=1..31)  # disabled
to_hour = Slider(24, range=0..24)  # disabled
from_month = Slider(2, range=1..12)  # disabled
to_month = Slider(2, range=1..12)  # disabled
view_analysis_input = Point(<point referenced from the Rhino model>)  # disabled
to_day = Slider(7, range=1..31)  # disabled
run_daylight_analysis = BooleanToggle(True)  # disabled

custom_preview_lineweights = CustomPreviewLineweights(Geometry=site_boundary, Shader=ColourSwatch(SwatchColor=RGB(255, 14, 43)), Thickness=5, Absolute=False)
custom_edge_weights = CustomEdgeWeights()
colour_rgb = ColourRGB(Alpha=255, Red=47, Green=151, Blue=160)

# ---- group: Importing OSM data
file_path = FilePath("D:\PepperPlot\Data\OSM Map Data\Novotel Pune.osm")  # disabled
location = Location(FilePathText=file_path)  # -> OSMPointData, OSMFile, LongitudeDomain, LatitudeDomain; disabled
osm_data = OSMData(
    OSMPointData=location.OSMPointData,
    OSMFilePath=location.OSMFile,
    Feature="building",
    Generate3d=False,
    IndividualOutputs=False)  # -> Ways, FeatureKey; disabled

# ----
multiplication = Multiplication(A=765, B=10.7639)
multiplication_2 = Multiplication(A=765, B=10.7639)
multiplication_3 = Multiplication(A=17391, B=10.7639)
multiplication_4 = Multiplication(A=10018, B=10.7639)
text = Text("Cr.")
text_2 = Text("Cr.")
text_3 = Text("Cr.")
text_4 = Text("Cr.")
panel_2 = Panel("OUTPUTS")

# ---- group: Massing Generation
streetnetworksynthesist = StreetNetworkSynthesisT(
    Boundary=site_boundary,
    IniStreets=initial_streets,
    MinLength=min_length_of_street_segment_2,
    MaxLength=max_length_of_street_segment_2,
    MinDist=40,
    RandomAngle=5,
    MaxArms=3,
    TreeDepth=depth_of_street_hierarchy_2)
road_network = Geometry(streetnetworksynthesist)
panel_3 = Panel("MAIN STREET NETWORK")
division = Division(A=street_width_2, B=2)
site_division = PolygonsFromLines(Lines=road_network, MinBlockSize=0)  # -> Polygons, SynchronizedValues
offset_curve = Offset(Curve=site_division.Polygons, Distance=division, Plane=PlaneXY(0, 0, 0), Corners=1)  # -> flatten(Curve)
parcels = Parcels(
    Polygons=site_division.Polygons,
    MaxParcelArea=max_plot_area_2,
    ConnectionDistance=division,
    StreetOffset=min_plot_width_2)
curve_to_polyline = CurveToPolyline(Curve=offset_curve, ToleranceDistance=0, ToleranceAngle=0)  # -> Polyline, Segments
panel_4 = Panel("Plots")
all_plots_including_open_space = Geometry(parcels)
panel_5 = Panel("Blocks")
area = Area(Geometry=curve_to_polyline.Polyline)  # -> flatten(Area), Centroid
area_2 = Area(Geometry=all_plots_including_open_space)  # -> flatten(Area), Centroid
mass_addition = MassAddition(Input=area.Area)  # -> Result, PartialResults
panel_6 = Panel("Building Footprint")
panel_7 = Panel("Building Mass Configuration")

# ----
boundary_surfaces = BoundarySurfaces(Edges=curve_to_polyline.Polyline)

# ---- group: Roads
boundary_surfaces_2 = BoundarySurfaces(Edges=site_boundary)
unit_z = UnitZ(Factor=-0.1)
extrude = Extrude(Base=boundary_surfaces, Direction=unit_z)
trim_solid = TrimSolid(Shape=boundary_surfaces_2, Cutters=extrude)
custom_preview = CustomPreview(Geometry=trim_solid, Material=ColourSwatch(SwatchColor=RGB(153, 153, 153)))

# ----
context_bake = ContextBake(Content=trim_solid)
context_bake_2 = ContextBake(Content=all_plots_including_open_space)

brep = Brep(flatten(all_plots_including_open_space))
list_length = ListLength(List=brep)
panel_8 = Panel(brep)
division_2 = Division(A=open_space_2, B=100)
division_3 = Division(A=amenity_space_2, B=100)
random_split_list = RandomSplitList(MasterList=brep, Seed=alternatives_for_open_space_distribution_2, Split=division_2)  # -> ListA, ListB
random_split_list_2 = RandomSplitList(MasterList=random_split_list.ListA, Seed=alternatives_for_amenity_space_distribut_2, Split=division_3)  # -> ListA, ListB
plots = Geometry(random_split_list_2.ListA)
brep_2 = Brep(random_split_list.ListB)
brep_3 = Brep(random_split_list_2.ListB)
custom_preview_2 = CustomPreview(Geometry=random_split_list_2.ListA, Material=ColourSwatch(SwatchColor=RGB(94, 57, 0)))
custom_preview_3 = CustomPreview(Geometry=brep_2, Material=ColourSwatch(SwatchColor=RGB(127, 214, 0)))
custom_preview_4 = CustomPreview(Geometry=brep_3, Material=ColourSwatch(SwatchColor=RGB(106, 196, 203)))

all_plots = Geometry(plots)

# ---- group: Massing Generation (continued)
buildable_area = BuildableArea(
    Parcels=all_plots,
    Blocks=curve_to_polyline.Polyline,
    RoadSetback=road_face_setback_2,
    SideSetback=side_setback_2,
    BackSetback=back_setback_2,
    Tolerance=0.1)
geometry = Geometry(buildable_area)
building_generation = BuildingGeneration(
    BuildableArea=geometry,
    Parcels=all_plots_including_open_space,
    Blocks=curve_to_polyline.Polyline,
    BuildingDepth=building_depth_2,
    BuildingLength=building_length_2,
    BuildingType=0,
    Location=area_2.Centroid,
    FAR=floor_area_ratio_far_2,
    FloorHeight=floor_height_2)  # -> BuildingFootprint, flatten(NumberOfFloors), BuildingHeight, FAR, flatten(GFA)
curve = Curve(building_generation.BuildingFootprint)
mass_addition_2 = MassAddition(Input=building_generation.GFA)  # -> Result, PartialResults
unit_z_2 = UnitZ(Factor=building_generation.BuildingHeight)
extrude_2 = Extrude(Base=curve, Direction=unit_z_2)
cap_holes = CapHoles(Brep=extrude_2)  # -> flatten(Brep)

# ----
division_4 = Division(A=commercial_buildings_2, B=100)
division_5 = Division(A=residential_buildings_2, B=100)
random_split_list_3 = RandomSplitList(MasterList=cap_holes, Seed=alternatives_for_commercial_space_distri_2, Split=division_4)  # -> ListA, ListB
random_split_list_4 = RandomSplitList(MasterList=random_split_list_3.ListA, Seed=alternatives_for_residential_space_distr_2, Split=division_5)  # -> ListA, ListB
brep_4 = Brep(random_split_list_3.ListB)
brep_5 = Brep(random_split_list_4.ListB)
brep_6 = Brep(random_split_list_4.ListA)
custom_preview_5 = CustomPreview(Geometry=brep_5, Material=ColourSwatch(SwatchColor=RGB(246, 238, 64)))
custom_preview_6 = CustomPreview(Geometry=brep_6, Material=ColourSwatch(SwatchColor=RGB(247, 157, 64)))
custom_preview_7 = CustomPreview(Geometry=brep_4, Material=ColourSwatch(SwatchColor=RGB(45, 83, 255)))

context_bake_3 = ContextBake(CommercialBuildings=brep_4)
context_bake_4 = ContextBake(MixedUseBuildings=brep_6)
context_bake_5 = ContextBake(ResidentialBuildings=brep_5)
brep_edges = BrepEdges(Brep=[brep_4, brep_5, brep_6])  # -> Naked, Interior, NonManifold
custom_preview_lineweights_2 = CustomPreviewLineweights(Geometry=brep_edges.Interior, Shader=ColourSwatch(SwatchColor=RGB(0, 0, 0)), Thickness=1, Absolute=False)
custom_preview_lineweights_3 = CustomPreviewLineweights(
    Geometry=[all_plots_including_open_space, geometry],
    Shader=ColourSwatch(SwatchColor=RGB(255, 14, 43)),
    Thickness=1,
    Absolute=False)

# ---- group: Daylight Analysis
file_path_2 = FilePath("D:\PepperPlot\Data\Weather files\IND_PUNE_430630_ISHRAE1M\IND_PUNE_430630_ISHRAE1M.epw")  # disabled
importlocation = Ladybug_ImportLocation(epwFile=file_path_2)  # -> location; disabled; plug-in component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
analysisperiod = Ladybug_AnalysisPeriod(fromMonth=from_month, fromDay=from_day, toMonth=to_month, toDay=to_day, toHour=to_hour)  # -> out, analysisPeriod; disabled; plug-in component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
boundary_surfaces_3 = BoundarySurfaces(Edges=site_boundary)  # disabled
sunpath = Ladybug_SunPath(
    location=importlocation,
    hour=12,
    day=21,
    month=12,
    timeStep=1,
    analysisPeriod=analysisperiod.analysisPeriod,
    dailyOrAnnualSunPath=True)  # -> out, sunVectors, sunAltitudes, sunAzimuths, port, sunSpheresMesh, sunPathCrvs, compassCrvs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; disabled; plug-in component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
brep_7 = Brep([cap_holes, boundary_surfaces_3])  # disabled
context = Brep(cap_holes)  # disabled
geometry_2 = Geometry([sunpath.sunPathCrvs, sunpath.compassCrvs, sunpath.altitudeCrvs])  # disabled
sunlighthoursanalysis = Ladybug_SunlightHoursAnalysis(
    geometry=flatten(brep_7),
    context=flatten(context),
    gridSize=5,
    disFromBase=0.1,
    sunVectors=flatten(sunpath.sunVectors),
    timeStep=1,
    runIt=run_daylight_analysis)  # -> out, contextMesh, analysisMesh, testPts, testVec, port, sunlightHoursResult, sunlightHoursMesh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; disabled; plug-in component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
scale = Scale(Geometry=geometry_2, Center=Point(0, 0, 0), Factor=2)  # -> Geometry, Transform; disabled
geometry_3 = Geometry(scale.Geometry)  # disabled

# ---- group: View Analysis
geometry_4 = Geometry(curve)  # disabled
explode = Explode(Curve=geometry_4, Recursive=True)  # -> flatten(Segments), Vertices; disabled
panel_9 = Panel(explode.Segments)  # disabled
line = Line(explode.Segments)  # disabled
isovist = Isovist(
    VantagePointS=view_analysis_input,
    ObstacleLines=line,
    ViewingDirection=Vector(0, 1, 0),
    ViewingRange=800,
    ViewingAngle=360,
    Precision=360,
    ShowPolygon=True,
    ShowRadials=True,
    UseGPU=False)  # -> IsovistPolygon, Radials, ObstacleVisibility, IsovistProperties; disabled
list_item = ListItem(List=isovist.IsovistProperties, Index=3, Wrap=True)  # disabled
list_item_2 = ListItem(List=isovist.IsovistProperties, Index=0, Wrap=True)  # disabled
surface = Surface(isovist.IsovistPolygon)  # disabled
multiplication_5 = Multiplication(A=list_item, B=100)  # disabled

# ----
custom_preview_8 = CustomPreview(Geometry=cap_holes, Material=colour_rgb)
context_bake_6 = ContextBake(BuildablePlots=random_split_list_2.ListA)
context_bake_7 = ContextBake(OpenSpace=brep_2)
context_bake_8 = ContextBake(AmenitySpace=brep_3)
view_area = Panel(list_item_2)
custom_preview_9 = CustomPreview(
    Geometry=[surface, isovist.Radials],
    Material={diffuse=RGB(221, 160, 221), emission=RGB(66, 48, 66), shine=0.5, specular=RGB(255, 255, 255), transparency=0})
compactness = Panel(multiplication_5)
number_of_floors = Panel(building_generation.NumberOfFloors)
gross_floor_area_gfa = Panel(building_generation.GFA)
building_heights = Panel(building_generation.BuildingHeight)
total_gross_floor_area_gfa = Panel(mass_addition_2.Result)

# ---- group: Floor Generation
bounds = Bounds(Numbers=building_generation.NumberOfFloors)
deconstruct_domain = DeconstructDomain(Domain=bounds)  # -> Start, End
series = Series(Start=0, Step=floor_height_2, Count=deconstruct_domain.End)  # -> flatten(Series)
unit_z_3 = UnitZ(Factor=series)
xy_plane = XYPlane(Origin=unit_z_3)
bb_section = BBSection(Mesh=brep_6, Planes=xy_plane, Thickness=0, Deeper=0)
residential_floors = BBSection(Mesh=brep_5, Planes=xy_plane, Thickness=0, Deeper=0)
commercial_floors = BBSection(Mesh=brep_4, Planes=xy_plane, Thickness=0, Deeper=0)
area_3 = Area(Geometry=bb_section)  # -> Area, Centroid
area_4 = Area(Geometry=residential_floors)  # -> Area, Centroid
area_5 = Area(Geometry=commercial_floors)  # -> Area, Centroid
type = Type(<hostobjecttype referenced from the Revit model>, SelectedBuiltInCategory="autodesk.revit.category.local:floors")  # disabled
add_floor = AddFloor(Boundary=bb_section, Type=type, Structural=True, TrackingMode=2)  # disabled

# ----
concatenate = Concatenate(FragmentA="Level - ", FragmentB=series)
merge = Merge(Data1=commercial_floors, Data2=residential_floors, Data3=bb_section)

# ---- group: Floor Generation (continued)
add_level = AddLevel(Elevation=series, Name=concatenate, TrackingMode=2)  # disabled

# ---- group: Wall Generation
curve_2 = Curve(curve)  # disabled
explode_2 = Explode(Curve=curve_2, Recursive=True)  # -> Segments, Vertices; disabled
curve_3 = Curve(explode_2.Segments)  # disabled
subtraction = Subtraction(A=building_generation.BuildingHeight)  # -> flatten(Result); disabled
element_parameter = ElementParameter(Element=add_floor, Parameter=<geometry referenced from the Revit model>)  # -> Element, Value; disabled
list_item_3 = ListItem(List=curve_3, Index=0, Wrap=True)  # disabled
type_2 = Type(<hostobjecttype referenced from the Revit model>, SelectedBuiltInCategory="autodesk.revit.category.local:walls")  # disabled
add_wall_curve = AddWallCurve(
    Type=type_2,
    Level=add_level,
    Height=subtraction,
    LocationLine=2,
    Flipped=False,
    AllowJoins=True,
    StructuralUsage=0,
    TrackingMode=2)  # disabled

# ----
custom_preview_lineweights_4 = CustomPreviewLineweights(Geometry=merge, Shader=ColourSwatch(SwatchColor=RGB(0, 0, 0)), Thickness=1, Absolute=False)

# ---- group: Area Calculation
area_6 = Area(Geometry=plots)  # -> Area, Centroid
clean_tree = CleanTree(RemoveNulls=True, RemoveInvalid=True, RemoveEmpty=False, Tree=area_5.Area)  # -> flatten(Tree)
boundary_surfaces_4 = BoundarySurfaces(Edges=site_boundary)
area_7 = Area(Geometry=brep_3)  # -> Area, Centroid
area_8 = Area(Geometry=trim_solid)  # -> Area, Centroid
area_9 = Area(Geometry=brep_2)  # -> Area, Centroid
clean_tree_2 = CleanTree(RemoveNulls=True, RemoveInvalid=True, RemoveEmpty=False, Tree=area_6.Area)
mass_addition_3 = MassAddition(Input=clean_tree)  # -> Result, PartialResults
area_10 = Area(Geometry=boundary_surfaces_4)  # -> Area, Centroid
clean_tree_3 = CleanTree(RemoveNulls=True, RemoveInvalid=True, RemoveEmpty=False, Tree=area_4.Area)  # -> flatten(Tree)
clean_tree_4 = CleanTree(RemoveNulls=True, RemoveInvalid=True, RemoveEmpty=False, Tree=area_3.Area)  # -> flatten(Tree)
clean_tree_5 = CleanTree(RemoveNulls=True, RemoveInvalid=True, RemoveEmpty=False, Tree=area_7.Area)  # -> flatten(Tree)
clean_tree_6 = CleanTree(RemoveNulls=True, RemoveInvalid=True, RemoveEmpty=False, Tree=area_8.Area)  # -> flatten(Tree)
clean_tree_7 = CleanTree(RemoveNulls=True, RemoveInvalid=True, RemoveEmpty=False, Tree=area_9.Area)  # -> flatten(Tree)
mass_addition_4 = MassAddition(Input=clean_tree_2)  # -> flatten(Result), PartialResults
division_6 = Division(A=area_10.Area, B=10000)
round_to_decimal_place = RoundToDecimalPlace(NumberX=mass_addition_3.Result, DecimalPlace=0, RoundType=0)  # -> Rounded, Difference
mass_addition_5 = MassAddition(Input=clean_tree_3)  # -> Result, PartialResults
mass_addition_6 = MassAddition(Input=clean_tree_4)  # -> Result, PartialResults
round_to_decimal_place_2 = RoundToDecimalPlace(NumberX=mass_addition_5.Result, DecimalPlace=0, RoundType=0)  # -> Rounded, Difference
round_to_decimal_place_3 = RoundToDecimalPlace(NumberX=clean_tree_6, DecimalPlace=0, RoundType=0)  # -> Rounded, Difference
mass_addition_7 = MassAddition(Input=clean_tree_7)  # -> Result, PartialResults
mass_addition_8 = MassAddition(Input=clean_tree_5)  # -> Result, PartialResults
round_to_decimal_place_4 = RoundToDecimalPlace(NumberX=mass_addition_6.Result, DecimalPlace=0, RoundType=0)  # -> Rounded, Difference
multiplication_6 = Multiplication(A=division_6, B=150)
total_commercial_space_area = Panel(round_to_decimal_place.Rounded)
residential_space_area = Panel(clean_tree_3)
commercial_space_area = Panel(clean_tree)
mixed_use_space_area = Panel(clean_tree_4)
amenity_space_area = Panel(clean_tree_5)
road_area = Panel(round_to_decimal_place_3.Rounded)
total_residential_space_area = Panel(round_to_decimal_place_2.Rounded)
number_of_trees_to_be_planted = Panel(multiplication_6)
total_amenity_space_area = Panel(mass_addition_8.Result)
total_site_area = Panel(area_10.Area)
open_space_area = Panel(clean_tree_7)
total_open_space_area = Panel(mass_addition_7.Result)
plot_area = Panel(clean_tree_2)
total_sellable_plot_area = Panel(mass_addition_4.Result)
total_mixed_use_space_area = Panel(round_to_decimal_place_4.Rounded)
text_5 = Text("sq.m.")
text_6 = Text("sq.m.")
text_7 = Text("sq.m.")
mass_addition_9 = MassAddition(Input=[mass_addition_3.Result, mass_addition_5.Result, mass_addition_6.Result])  # -> Result, PartialResults
round_to_decimal_place_5 = RoundToDecimalPlace(NumberX=area_10.Area, DecimalPlace=0, RoundType=0)  # -> Rounded, Difference
round_to_decimal_place_6 = RoundToDecimalPlace(NumberX=mass_addition_8.Result, DecimalPlace=0, RoundType=0)  # -> Rounded, Difference
round_to_decimal_place_7 = RoundToDecimalPlace(NumberX=mass_addition_7.Result, DecimalPlace=0, RoundType=0)  # -> Rounded, Difference
round_to_decimal_place_8 = RoundToDecimalPlace(NumberX=total_sellable_plot_area, DecimalPlace=0, RoundType=0)  # -> Rounded, Difference
concatenate_2 = Concatenate(FragmentA=round_to_decimal_place.Rounded, FragmentB=text_5)
concatenate_3 = Concatenate(FragmentA=round_to_decimal_place_4.Rounded, FragmentB=text_6)
concatenate_4 = Concatenate(FragmentA=round_to_decimal_place_2.Rounded, FragmentB=text_7)
text_8 = Text("sq.m.")
round_to_decimal_place_9 = RoundToDecimalPlace(NumberX=mass_addition_9.Result, DecimalPlace=0, RoundType=0)  # -> Rounded, Difference
text_9 = Text("sq.m.")
text_10 = Text("sq.m.")
text_11 = Text("sq.m.")
text_12 = Text("sq.m.")
total_mixed_use_space_area_2 = Panel(concatenate_3)
concatenate_5 = Concatenate(FragmentA=road_area, FragmentB=text_8)
total_residential_space_area_2 = Panel(concatenate_4)
total_commercial_space_area_2 = Panel(concatenate_2)
concatenate_6 = Concatenate(FragmentA=round_to_decimal_place_5.Rounded, FragmentB=text_9)
concatenate_7 = Concatenate(FragmentA=round_to_decimal_place_6.Rounded, FragmentB=text_10)
concatenate_8 = Concatenate(FragmentA=round_to_decimal_place_7.Rounded, FragmentB=text_11)
concatenate_9 = Concatenate(FragmentA=round_to_decimal_place_8.Rounded, FragmentB=text_12)
total_developable_area = Panel(round_to_decimal_place_9.Rounded)
road_area_2 = Panel(concatenate_5)
total_amenity_space_area_2 = Panel(concatenate_7)
total_site_area_2 = Panel(concatenate_6)
total_open_space_area_2 = Panel(concatenate_8)
total_sellable_plot_area_2 = Panel(concatenate_9)
text_13 = Text("sq.m.")
concatenate_10 = Concatenate(FragmentA=round_to_decimal_place_9.Rounded, FragmentB=text_13)
multiplication_7 = Multiplication(A=round_to_decimal_place_5.Rounded, B=0.000247105)
text_14 = Text(" Acre")
round_to_decimal_place_10 = RoundToDecimalPlace(NumberX=multiplication_7, DecimalPlace=0, RoundType=0)  # -> Rounded, Difference
total_developable_area_2 = Panel(concatenate_10)
concatenate_11 = Concatenate(FragmentA=round_to_decimal_place_10.Rounded, FragmentB=text_14)
total_site_area_3 = Panel(concatenate_11)

# ---- group: Cost Calculation
multiplication_8 = Multiplication(A=765, B=10.7639)
multiplication_9 = Multiplication(A=5, B=10.7639, C=round_to_decimal_place_3.Rounded)
multiplication_10 = Multiplication(A=2000, B=10.7639, C=round_to_decimal_place_9.Rounded)
division_7 = Division(A=multiplication_9, B=10000000)
division_8 = Division(A=multiplication_10, B=10000000)
multiplication_11 = Multiplication(A=round_to_decimal_place_5.Rounded, B=multiplication_8)
round_to_decimal_place_11 = RoundToDecimalPlace(NumberX=division_7, DecimalPlace=1, RoundType=0)  # -> Rounded, Difference
round_to_decimal_place_12 = RoundToDecimalPlace(NumberX=division_8, DecimalPlace=1, RoundType=0)  # -> Rounded, Difference
division_9 = Division(A=multiplication_11, B=10000000)
round = Round(Number=division_9)  # -> Nearest, Floor, Ceiling
python_3_script = Python3Script(x=round_to_decimal_place_11.Rounded)  # -> out, a
# ---------- python_3_script: Python ----------
input_number = x
out=str(x)
a=out
# ---------- end python_3_script ----------
text_15 = Text("Cr.")
python_3_script_2 = Python3Script(x=round_to_decimal_place_12.Rounded)  # -> out, a; same code as python_3_script
text_16 = Text("Cr.")
text_17 = Text("Cr.")
concatenate_12 = Concatenate(FragmentA=python_3_script.a, FragmentB=text_15)
concatenate_13 = Concatenate(FragmentA=python_3_script_2.a, FragmentB=text_16)
python_3_script_3 = Python3Script(x=round.Nearest)  # -> out, a; same code as python_3_script
mass_addition_10 = MassAddition(Input=[python_3_script_3.a, python_3_script_2.a, python_3_script.a])  # -> Result, PartialResults
concatenate_14 = Concatenate(FragmentA=mass_addition_10.Result, FragmentB=text_17)
text_18 = Text("Cr.")
road_cost = Panel(concatenate_12)
total_cost = Panel(concatenate_14)
construction_cost = Panel(concatenate_13)
concatenate_15 = Concatenate(FragmentA=python_3_script_3.a, FragmentB=text_18)
land_cost = Panel(concatenate_15)

# ----
total_cost_2 = Number(mass_addition_10.Result)
percentage = Percentage(Number=clean_tree_4, Percent=80)
percentage_2 = Percentage(Number=clean_tree_4, Percent=20)
multiplication_12 = Multiplication(A=clean_tree, B=multiplication_3)
multiplication_13 = Multiplication(A=clean_tree_3, B=multiplication_4)
multiplication_14 = Multiplication(A=mass_addition_5.Result, B=multiplication_4)
percentage_3 = Percentage(Number=mass_addition_6.Result, Percent=80)
multiplication_15 = Multiplication(A=mass_addition_3.Result, B=multiplication_3)
percentage_4 = Percentage(Number=mass_addition_6.Result, Percent=20)
multiplication_16 = Multiplication(A=total_sellable_plot_area, B=multiplication)
multiplication_17 = Multiplication(A=plot_area, B=multiplication_2)
round_2 = Round(Number=multiplication_13)  # -> Nearest, Floor, Ceiling
round_3 = Round(Number=multiplication_12)  # -> Nearest, Floor, Ceiling
multiplication_18 = Multiplication(A=percentage, B=multiplication_4)
multiplication_19 = Multiplication(A=percentage_2, B=multiplication_3)
round_to_decimal_place_13 = RoundToDecimalPlace(NumberX=multiplication_14, DecimalPlace=0, RoundType=0)  # -> Rounded, Difference
round_to_decimal_place_14 = RoundToDecimalPlace(NumberX=multiplication_15, DecimalPlace=0, RoundType=0)  # -> Rounded, Difference
multiplication_20 = Multiplication(A=percentage_4, B=multiplication_3)
multiplication_21 = Multiplication(A=percentage_3, B=multiplication_4)
round_4 = Round(Number=multiplication_16)  # -> Nearest, Floor, Ceiling
round_5 = Round(Number=multiplication_17)  # -> Nearest, Floor, Ceiling
mass_addition_11 = MassAddition(Input=[multiplication_20, multiplication_21])  # -> Result, PartialResults
addition = Addition(A=multiplication_19, B=multiplication_18)
round_to_decimal_place_15 = RoundToDecimalPlace(NumberX=addition, DecimalPlace=0, RoundType=0)  # -> Rounded, Difference
round_to_decimal_place_16 = RoundToDecimalPlace(NumberX=mass_addition_11.Result, DecimalPlace=0, RoundType=0)  # -> Rounded, Difference
python_3_script_4 = Python3Script(x=round_to_decimal_place_13.Rounded)  # -> out, a; same code as python_3_script
python_3_script_5 = Python3Script(x=round_2.Nearest)  # -> out, a; same code as python_3_script
python_3_script_6 = Python3Script(x=round_to_decimal_place_14.Rounded)  # -> out, a; same code as python_3_script
python_3_script_7 = Python3Script(x=round_3.Nearest)  # -> out, a; same code as python_3_script
python_3_script_8 = Python3Script(x=round_to_decimal_place_15.Rounded)  # -> out, a; same code as python_3_script
python_3_script_9 = Python3Script(x=round_to_decimal_place_16.Rounded)  # -> out, a; same code as python_3_script
python_3_script_10 = Python3Script(x=round_4.Nearest)  # -> out, a; same code as python_3_script
python_3_script_11 = Python3Script(x=round_5.Nearest)  # -> out, a; same code as python_3_script
market_price_of_commercial_space = Panel(python_3_script_7.a)
total_market_price_of_commercial_space = Panel(python_3_script_6.a)
market_price_of_mixed_use_space = Panel(python_3_script_8.a)
total_market_price_of_residential_space = Panel(python_3_script_4.a)
total_market_price_of_mixed_use_space = Panel(python_3_script_9.a)
market_price_of_residential_space = Panel(python_3_script_5.a)
market_price_of_plots = Panel(python_3_script_11.a)
market_price_of_plots_2 = Panel(python_3_script_10.a)
mass_addition_12 = MassAddition(Input=[round_to_decimal_place_14.Rounded, round_to_decimal_place_13.Rounded, round_to_decimal_place_16.Rounded])  # -> Result, PartialResults
division_10 = Division(A=python_3_script_6.a, B=10000000)
division_11 = Division(A=python_3_script_4.a, B=10000000)
division_12 = Division(A=python_3_script_9.a, B=10000000)
round_to_decimal_place_17 = RoundToDecimalPlace(NumberX=mass_addition_12.Result, DecimalPlace=0, RoundType=0)  # -> Rounded, Difference
round_to_decimal_place_18 = RoundToDecimalPlace(NumberX=division_10, DecimalPlace=1, RoundType=0)  # -> Rounded, Difference
round_to_decimal_place_19 = RoundToDecimalPlace(NumberX=division_11, DecimalPlace=0, RoundType=0)  # -> Rounded, Difference
round_to_decimal_place_20 = RoundToDecimalPlace(NumberX=division_12, DecimalPlace=0, RoundType=0)  # -> Rounded, Difference
python_3_script_12 = Python3Script(x=round_to_decimal_place_17.Rounded)  # -> out, a; same code as python_3_script
concatenate_16 = Concatenate(FragmentA=round_to_decimal_place_19.Rounded, FragmentB=text_2)
concatenate_17 = Concatenate(FragmentA=round_to_decimal_place_18.Rounded, FragmentB=text)
concatenate_18 = Concatenate(FragmentA=round_to_decimal_place_20.Rounded, FragmentB=text_3)
total_market_price_of_development = Panel(python_3_script_12.a)
total_market_price_of_commercial_space_2 = Panel(concatenate_17)
total_market_price_of_residential_space_2 = Panel(concatenate_16)
total_market_price_of_mixed_use_space_2 = Panel(concatenate_18)
division_13 = Division(A=python_3_script_12.a, B=10000000)
round_to_decimal_place_21 = RoundToDecimalPlace(NumberX=division_13, DecimalPlace=0, RoundType=0)  # -> Rounded, Difference
total_market_price = Number(round_to_decimal_place_21.Rounded)
subtraction_2 = Subtraction(A=total_market_price, B=total_cost_2)
capital_gain = Number(subtraction_2)
division_14 = Division(A=capital_gain, B=total_cost_2)
multiplication_22 = Multiplication(A=division_14, B=100)
round_to_decimal_place_22 = RoundToDecimalPlace(NumberX=multiplication_22, DecimalPlace=1, RoundType=0)  # -> Rounded, Difference
concatenate_19 = Concatenate(FragmentA=round_to_decimal_place_22.Rounded, FragmentB="%")
roi = Panel(concatenate_19)
concatenate_20 = Concatenate(FragmentA=round_to_decimal_place_21.Rounded, FragmentB=text_4)
total_market_price_of_development_2 = Panel(concatenate_20)

# ---- group: output
curve_4 = Curve(<curve referenced from the Rhino model>)
divide_curve = DivideCurve(Curve=curve_4, Count=10, Kinks=False)  # -> reverse(Points), Tangents, Parameters
list_item_4 = ListItem(List=divide_curve.Points, Index=0, Wrap=True)
list_item_5 = ListItem(List=divide_curve.Points, Index=3, Wrap=True)
list_item_6 = ListItem(List=divide_curve.Points, Index=6, Wrap=True)
list_item_7 = ListItem(List=divide_curve.Points, Index=9, Wrap=True)
list_item_8 = ListItem(List=divide_curve.Points, Index=8, Wrap=True)
list_item_9 = ListItem(List=divide_curve.Points, Index=5, Wrap=True)
list_item_10 = ListItem(List=divide_curve.Points, Index=2, Wrap=True)
list_item_11 = ListItem(List=divide_curve.Points, Index=7, Wrap=True)
list_item_12 = ListItem(List=divide_curve.Points, Index=1, Wrap=True)
list_item_13 = ListItem(List=divide_curve.Points, Index=4, Wrap=True)
geometry_5 = Geometry(list_item_4)
geometry_6 = Geometry(list_item_5)
geometry_7 = Geometry(list_item_6)
geometry_8 = Geometry(list_item_9)
geometry_9 = Geometry(list_item_7)
geometry_10 = Geometry(list_item_8)
geometry_11 = Geometry(list_item_10)
geometry_12 = Geometry(list_item_11)
number_slider = Slider(834, range=100..1000)  # disabled
geometry_13 = Geometry(list_item_13)
geometry_14 = Geometry(list_item_12)
unit_z_4 = UnitZ(Factor=1)  # disabled
text_19 = Text("Site Area ")
text_20 = Text(concatenate_11)
text_21 = Text("Road Cost ")
text_22 = Text(concatenate_12)
text_23 = Text("Total Cost ")
text_24 = Text("ROI ")
text_25 = Text(concatenate_19)
text_26 = Text(concatenate_14)
text_27 = Text("Commercial Space")
text_28 = Text("Construction Cost ")
text_29 = Text(concatenate_13)
text_30 = Text("Market Price ")
text_31 = Text("Land Cost ")
point = Point(Point(149.3842346, -246.6878816, 0))  # disabled
text_32 = Text(concatenate_20)
text_33 = Text(concatenate_15)
text_34 = Text(concatenate_17)
text_35 = Text("Mixed-Use Space")
text_36 = Text(concatenate_18)
text_37 = Text("Residential Space ")
text_38 = Text(concatenate_16)
concatenate_21 = Concatenate(FragmentA=text_19, FragmentB=text_20)
concatenate_22 = Concatenate(FragmentA=text_21, FragmentB=text_22)
colour_swatch = ColourSwatch(SwatchColor=RGB(255, 255, 255))
concatenate_23 = Concatenate(FragmentA=text_24, FragmentB=text_25)
concatenate_24 = Concatenate(FragmentA=text_23, FragmentB=text_26)
concatenate_25 = Concatenate(FragmentA=text_28, FragmentB=text_29)
concatenate_26 = Concatenate(FragmentA=text_30, FragmentB=text_32)
concatenate_27 = Concatenate(FragmentA=text_31, FragmentB=text_33)
colour_swatch_2 = ColourSwatch(SwatchColor=RGB(255, 255, 255))
concatenate_28 = Concatenate(FragmentA=text_27, FragmentB=text_34)
concatenate_29 = Concatenate(FragmentA=text_35, FragmentB=text_36)
concatenate_30 = Concatenate(FragmentA=text_37, FragmentB=text_38)
line_sdl = LineSDL(Start=point, Direction=unit_z_4, Length=number_slider)  # disabled
text_tag = TextTag(Location=geometry_9, Text=concatenate_22, Colour=colour_swatch)
text_tag_2 = TextTag(Location=geometry_14, Text=concatenate_23, Colour=colour_swatch)
text_tag_3 = TextTag(Location=geometry_7, Text=concatenate_24, Colour=colour_swatch)
text_tag_4 = TextTag(Location=geometry_10, Text=concatenate_25, Colour=colour_swatch)
text_tag_5 = TextTag(Location=geometry_5, Text=concatenate_21, Colour=colour_swatch)
text_tag_6 = TextTag(Location=geometry_11, Text=concatenate_26, Colour=colour_swatch)
text_tag_7 = TextTag(Location=geometry_12, Text=concatenate_27, Colour=colour_swatch)
text_tag_8 = TextTag(Location=geometry_13, Text=concatenate_30, Colour=colour_swatch_2)
text_tag_9 = TextTag(Location=geometry_6, CommercialSpace=concatenate_28, Colour=colour_swatch_2)
text_tag_10 = TextTag(Location=geometry_8, Text=concatenate_29, Colour=colour_swatch_2)
curve_5 = Curve(<curve referenced from the Rhino model>)
divide_curve_2 = DivideCurve(Curve=curve_5, Count=9, Kinks=False)  # -> reverse(Points), Tangents, Parameters
list_item_14 = ListItem(List=divide_curve_2.Points, Index=1, Wrap=True)
list_item_15 = ListItem(List=divide_curve_2.Points, Index=8, Wrap=True)
list_item_16 = ListItem(List=divide_curve_2.Points, Index=2, Wrap=True)
list_item_17 = ListItem(List=divide_curve_2.Points, Index=0, Wrap=True)
list_item_18 = ListItem(List=divide_curve_2.Points, Index=6, Wrap=True)
list_item_19 = ListItem(List=divide_curve_2.Points, Index=7, Wrap=True)
list_item_20 = ListItem(List=divide_curve_2.Points, Index=5, Wrap=True)
list_item_21 = ListItem(List=divide_curve_2.Points, Index=3, Wrap=True)
list_item_22 = ListItem(List=divide_curve_2.Points, Index=4, Wrap=True)
geometry_15 = Geometry(list_item_14)
geometry_16 = Geometry(list_item_16)
geometry_17 = Geometry(list_item_15)
geometry_18 = Geometry(list_item_17)
geometry_19 = Geometry(list_item_18)
geometry_20 = Geometry(list_item_19)
geometry_21 = Geometry(list_item_20)
geometry_22 = Geometry(list_item_21)
geometry_23 = Geometry(list_item_22)
text_39 = Text("Road Area ")
text_40 = Text("Developable Area ")
sellable_plot_area = Text("Sellable Plot Area ")
text_41 = Text(concatenate_5)
text_42 = Text(concatenate_10)
text_43 = Text("Trees to be planted min. ")
text_44 = Text(multiplication_6)
text_45 = Text(concatenate_9)
text_46 = Text("Amenity Space ")
text_47 = Text("Open Space ")
text_48 = Text(concatenate_7)
text_49 = Text(concatenate_8)
text_50 = Text("Mixed-Use Space ")
text_51 = Text(concatenate_3)
text_52 = Text("Commercial Space")
text_53 = Text(concatenate_2)
text_54 = Text("Residential Space ")
text_55 = Text(concatenate_4)
concatenate_31 = Concatenate(FragmentA=text_39, FragmentB=text_41)
concatenate_32 = Concatenate(FragmentA=text_43, FragmentB=text_44)
concatenate_33 = Concatenate(FragmentA=text_40, FragmentB=text_42)
concatenate_34 = Concatenate(FragmentA=text_46, FragmentB=text_48)
concatenate_35 = Concatenate(FragmentA=text_47, FragmentB=text_49)
concatenate_36 = Concatenate(FragmentA=sellable_plot_area, FragmentB=text_45)
concatenate_37 = Concatenate(FragmentA=text_50, FragmentB=text_51)
concatenate_38 = Concatenate(FragmentA=text_52, FragmentB=text_53)
concatenate_39 = Concatenate(FragmentA=text_54, FragmentB=text_55)
text_tag_11 = TextTag(Location=geometry_15, Text=concatenate_31, Colour=colour_swatch)
text_tag_12 = TextTag(Location=geometry_17, Text=concatenate_32, Colour=colour_swatch)
text_tag_13 = TextTag(Location=geometry_16, Text=concatenate_33, Colour=colour_swatch)
text_tag_14 = TextTag(Location=geometry_19, Text=concatenate_34, Colour=colour_swatch)
text_tag_15 = TextTag(Location=geometry_20, Text=concatenate_35, Colour=colour_swatch)
text_tag_16 = TextTag(Location=geometry_18, Text=concatenate_36, Colour=colour_swatch)
text_tag_17 = TextTag(Location=geometry_21, Text=concatenate_37, Colour=colour_swatch)
text_tag_18 = TextTag(Location=geometry_22, Text=concatenate_38, Colour=colour_swatch)
text_tag_19 = TextTag(Location=geometry_23, Text=concatenate_39, Colour=colour_swatch)

# ----
context_bake_9 = ContextBake(ConstructionCost=concatenate_25)
context_bake_10 = ContextBake(RoadCost=concatenate_22)
context_bake_11 = ContextBake(LandCost=concatenate_27)
context_bake_12 = ContextBake(SiteArea=concatenate_21)
context_bake_13 = ContextBake(MarketPrice=concatenate_26)
context_bake_14 = ContextBake(ResidentialSpace=concatenate_30)
context_bake_15 = ContextBake(Content=concatenate_23)
context_bake_16 = ContextBake(TotalCost=concatenate_24)
context_bake_17 = ContextBake(CommercialSpace=concatenate_28)
context_bake_18 = ContextBake(MixedUseSpace=concatenate_29)
context_bake_19 = ContextBake(AmenitySpace=concatenate_34)
context_bake_20 = ContextBake(OpenSpace=concatenate_35)
context_bake_21 = ContextBake(RoadArea=concatenate_31)
context_bake_22 = ContextBake(TreesToBePlantedMin=concatenate_32)
context_bake_23 = ContextBake(DevelopableArea=concatenate_33)
context_bake_24 = ContextBake(MixedUseSpace=concatenate_37)
context_bake_25 = ContextBake(CommercialSpace=concatenate_38)
context_bake_26 = ContextBake(SellablePlotArea=concatenate_36)
context_bake_27 = ContextBake(ResidentialSpace=concatenate_39)

# ==== cluster CustomEdgeWeights: Creates lits for custom edge weighting. Each line segment can be assigned either custom or general weight. segments with custom weights are identifyied via custom weight point list
segments = ClusterInput()
pointsofinterest = ClusterInput()
customweights = ClusterInput()
generalweight = ClusterInput()
segments_2 = Line(segments)
generalweight_2 = Number(generalweight)
customweights_2 = Number(customweights)
pointsofinterest_2 = Point(pointsofinterest)
lng = ListLength(List=segments_2)
crv_cp = CurveClosestPoint(Point=graft(pointsofinterest_2), Curve=segments_2)  # -> Point, Parameter, Distance
series = Series(Start=0, Step=1, Count=lng)
sort = SortList(Keys=crv_cp.Distance, ValuesA=series)  # -> Keys, ValuesA
item = ListItem(List=sort.ValuesA, Index=0, Wrap=True)  # -> flatten(Item)
lng_2 = ListLength(List=item)
dup = DuplicateData(Data=customweights_2, Number=lng_2, Order=True)
c_script = CSharpScript(x=customweights_2, y=dup)  # -> out, A; inputs x: list of Double, y: list of Double
# ---------- c_script: C# usings ----------
using System.IO;
using System.Linq;
using System.Data;
using System.Drawing;
using System.Reflection;
using System.Windows.Forms;
using System.Xml;
using System.Xml.Linq;
using System.Runtime.InteropServices;

using Rhino.DocObjects;
using Rhino.Collections;
using GH_IO;
using GH_IO.Serialization;
# ---------- c_script: C# ----------
    if(x.Count == 1)
      A = y;
    else
      A = x;
# ---------- end c_script ----------
ids = Integer(item)
c_list = CSharpScript(edge_count=lng, ids=ids, weights=c_script.A, general_weight=generalweight_2)  # -> add_weight; inputs edge_count: Int32, ids: list of Int32, weights: list of Double, general_weight: Double
# ---------- c_list: C# ----------
    List<double> result = new List<double>(); //Enumerable.Repeat(general_weight, edge_count).ToList();

    for (int i = 0; i < edge_count * 2; i++)
    {
      result.Add(general_weight);
    }


    for (int i = 0; i < ids.Count; i++)
    {
      result[ids[i]*2] = weights[i];
      result[ids[i]*2 + 1] = weights[i];
    }

    add_weight = result;
# ---------- end c_list ----------
weight_list = Number(c_list)
weight_list_2 = ClusterOutput(weight_list)
