# Grasshopper definition final_building_12.gh (Grasshopper 1.0.7)
# plug-ins: DeCodingSpaces, Bowerbird2, Human, LunchBox, Pufferfish

alternatives_for_commercial_space_distri = Slider(20, range=0..50)  # "Alternatives for Commercial Space distribution"
alternatives_for_amenity_space_distribut = Slider(19, range=0..50)  # "Alternatives for Amenity Space distribution"
alternatives_for_residential_space_distr = Slider(26, range=0..50)  # "Alternatives for Residential Space distribution"
open_space = Slider(20, range=20..100)
amenity_space = Slider(10, range=5..100)
alternatives_for_open_space_distribution = Slider(10, range=0..50)
commercial_buildings = Slider(30, range=0..100)
residential_buildings = Slider(35, range=0..100)
min_length_of_street_segment = Slider(50, range=0..100)
floor_area_ratio_far = Slider(3.4, range=0.5..7)
max_length_of_street_segment = Slider(150, range=0..350)
building_length = Slider(19, range=3..100)
building_depth = Slider(21, range=3..100)
floor_height = Slider(3, range=3..4.5)
side_setback = Slider(1, range=1..6)
back_setback = Slider(1, range=1..6)
max_plot_area = Slider(999999, range=200000..1000000)
depth_of_street_hierarchy = Slider(3, range=0..4)
street_width = Slider(9, range=9..20)
site_boundary = Curve(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)
initial_streets = Curve([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])
min_plot_width = Slider(29, range=20..100)
road_face_setback = Slider(3, range=3..6)

panel = Panel("INPUTS")
site = GetGeometry(site_boundary, AnnotationTypeFilter=3966, AtLeast=1, AtMost=1, DeleteInput=False, Filter=1074081855, TreeAccess=False)
existing_roads = GetGeometry(initial_streets, AnnotationTypeFilter=3966, AtLeast=1, AtMost=1, DeleteInput=False, Filter=1074081855, TreeAccess=False)
multiplication = Multiplication(A=max_plot_area, B=100)
alternatives_for_open_space_distribution_2 = GetNumber(
    alternatives_for_open_space_distribution,
    AtLeast=1,
    AtMost=1,
    Maximum=1.797693135e+308,
    Minimum=-1.797693135e+308,
    TreeAccess=False)
street_width_2 = GetNumber(street_width, AtLeast=1, AtMost=1, Maximum=1.797693135e+308, Minimum=-1.797693135e+308, TreeAccess=False)
min_plot_width_2 = GetNumber(min_plot_width, AtLeast=1, AtMost=1, Maximum=1.797693135e+308, Minimum=-1.797693135e+308, TreeAccess=False)
alternatives_for_commercial_space_distri_2 = GetNumber(
    alternatives_for_commercial_space_distri,
    AtLeast=1,
    AtMost=1,
    Maximum=1.797693135e+308,
    Minimum=-1.797693135e+308,
    TreeAccess=False)  # "Alternatives for commercial space distribution"
alternatives_for_amenity_space_distribut_2 = GetNumber(
    alternatives_for_amenity_space_distribut,
    AtLeast=1,
    AtMost=1,
    Maximum=1.797693135e+308,
    Minimum=-1.797693135e+308,
    TreeAccess=False)  # "Alternatives for Amenity space distribution"
building_depth_2 = GetNumber(building_depth, AtLeast=1, AtMost=1, Maximum=1.797693135e+308, Minimum=-1.797693135e+308, TreeAccess=False)
back_setback_2 = GetNumber(back_setback, AtLeast=1, AtMost=1, Maximum=1.797693135e+308, Minimum=-1.797693135e+308, TreeAccess=False)
commercial_buildings_2 = GetNumber(commercial_buildings, AtLeast=1, AtMost=1, Maximum=1.797693135e+308, Minimum=-1.797693135e+308, TreeAccess=False)
residential_buildings_2 = GetNumber(residential_buildings, AtLeast=1, AtMost=1, Maximum=1.797693135e+308, Minimum=-1.797693135e+308, TreeAccess=False)
side_setback_2 = GetNumber(side_setback, AtLeast=1, AtMost=1, Maximum=1.797693135e+308, Minimum=-1.797693135e+308, TreeAccess=False)
amenity_space_2 = GetNumber(amenity_space, AtLeast=1, AtMost=1, Maximum=1.797693135e+308, Minimum=-1.797693135e+308, TreeAccess=False)
min_length_of_street_segment_2 = GetNumber(min_length_of_street_segment, AtLeast=1, AtMost=1, Maximum=1.797693135e+308, Minimum=-1.797693135e+308, TreeAccess=False)
max_plot_area_2 = GetNumber(multiplication, AtLeast=1, AtMost=1, Maximum=1.797693135e+308, Minimum=-1.797693135e+308, TreeAccess=False)
road_face_setback_2 = GetNumber(road_face_setback, AtLeast=1, AtMost=1, Maximum=1.797693135e+308, Minimum=-1.797693135e+308, TreeAccess=False)
building_length_2 = GetNumber(building_length, AtLeast=1, AtMost=1, Maximum=1.797693135e+308, Minimum=-1.797693135e+308, TreeAccess=False)
max_length_of_street_segment_2 = GetNumber(max_length_of_street_segment, AtLeast=1, AtMost=1, Maximum=1.797693135e+308, Minimum=-1.797693135e+308, TreeAccess=False)
floor_area_ratio_far_2 = GetNumber(floor_area_ratio_far, AtLeast=1, AtMost=1, Maximum=1.797693135e+308, Minimum=-1.797693135e+308, TreeAccess=False)
floor_height_2 = GetNumber(floor_height, AtLeast=1, AtMost=1, Maximum=1.797693135e+308, Minimum=-1.797693135e+308, TreeAccess=False)
open_space_2 = GetNumber(open_space, AtLeast=1, AtMost=1, Maximum=1.797693135e+308, Minimum=-1.797693135e+308, TreeAccess=False)
depth_of_street_hierarchy_2 = GetNumber(depth_of_street_hierarchy, AtLeast=1, AtMost=1, Maximum=1.797693135e+308, Minimum=-1.797693135e+308, TreeAccess=False)
alternatives_for_residential_space_distr_2 = GetNumber(
    alternatives_for_residential_space_distr,
    AtLeast=1,
    AtMost=1,
    Maximum=1.797693135e+308,
    Minimum=-1.797693135e+308,
    TreeAccess=False)  # "Alternatives for residential space distribution"
context_bake = ContextBake(InitalRoads=existing_roads)
context_bake_2 = ContextBake(SiteBoundary=site)
custom_preview_lineweights = CustomPreviewLineweights(Geometry=site, Shader=ColourSwatch(SwatchColor=RGB(255, 14, 43)), Thickness=5, Absolute=False)
custom_edge_weights = CustomEdgeWeights()
colour_rgb = ColourRGB(Alpha=255, Red=47, Green=151, Blue=160)
multiplication_2 = Multiplication(A=765, B=10.7639)
multiplication_3 = Multiplication(A=765, B=10.7639)
multiplication_4 = Multiplication(A=17391, B=10.7639)
multiplication_5 = Multiplication(A=10018, B=10.7639)
text = Text("Cr.")
text_2 = Text("Cr.")
text_3 = Text("Cr.")
text_4 = Text("Cr.")
panel_2 = Panel("OUTPUTS")

# ---- group: Massing Generation
streetnetworksynthesist = StreetNetworkSynthesisT(
    Boundary=site,
    IniStreets=existing_roads,
    MinLength=min_length_of_street_segment_2,
    MaxLength=max_length_of_street_segment_2,
    MinDist=30,
    RandomAngle=4,
    MaxArms=2,
    TreeDepth=depth_of_street_hierarchy_2)
road_network = Geometry(streetnetworksynthesist)
site_division = PolygonsFromLines(Lines=road_network, MinBlockSize=0)  # -> Polygons, SynchronizedValues
panel_3 = Panel("MAIN STREET NETWORK")
division = Division(A=street_width_2, B=2)
parcels = Parcels(
    Polygons=site_division.Polygons,
    MaxParcelArea=max_plot_area_2,
    ConnectionDistance=division,
    StreetOffset=min_plot_width_2)
all_plots_including_open_space = Geometry(parcels)
panel_4 = Panel("Plots")
panel_5 = Panel("Blocks")
area = Area(Geometry=all_plots_including_open_space)  # -> flatten(Area), Centroid
panel_6 = Panel("Building Footprint")
panel_7 = Panel("Building Mass Configuration")

# ----
explode = Explode(Curve=site_division.Polygons, Recursive=True)  # -> Segments, Vertices
join_curves = JoinCurves(Curves=explode.Segments, Preserve=False)
context_bake_3 = ContextBake(Content=all_plots_including_open_space)

brep = Brep(flatten(all_plots_including_open_space))
list_length = ListLength(List=brep)
panel_8 = Panel(brep)
division_2 = Division(A=open_space_2, B=100)
division_3 = Division(A=amenity_space_2, B=100)
random_split_list = RandomSplitList(MasterList=brep, Seed=alternatives_for_open_space_distribution_2, Split=division_2)  # -> ListA, ListB
random_split_list_2 = RandomSplitList(MasterList=random_split_list.ListA, Seed=alternatives_for_amenity_space_distribut_2, Split=division_3)  # -> ListA, ListB
plots = Geometry(random_split_list_2.ListA)
mesh = Mesh(random_split_list_2.ListA)
brep_2 = Brep(random_split_list.ListB)
brep_3 = Brep(random_split_list_2.ListB)
mesh_2 = Mesh(brep_2)
mesh_3 = Mesh(brep_3)
mesh_colours = MeshColours(Mesh=mesh, Colours=ColourSwatch(SwatchColor=RGB(94, 57, 0)))
mesh_colours_2 = MeshColours(Mesh=mesh_2, Colours=ColourSwatch(SwatchColor=RGB(127, 214, 0)))
mesh_colours_3 = MeshColours(Mesh=mesh_3, Colours=ColourSwatch(SwatchColor=RGB(106, 196, 203)))
context_bake_4 = ContextBake(BuildablePlots=mesh_colours)
context_bake_5 = ContextBake(OpenSpace=mesh_colours_2)
context_bake_6 = ContextBake(AmenitySpace=mesh_colours_3)

all_plots = Geometry(plots)
clean_tree = CleanTree(RemoveNulls=True, RemoveInvalid=True, RemoveEmpty=False, Tree=all_plots)

# ---- group: Massing Generation (continued)
offset_curve = Offset(Curve=join_curves, Distance=division, Plane=PlaneXY(0, 0, 0), Corners=1)  # -> flatten(Curve)
curve_to_polyline = CurveToPolyline(Curve=offset_curve, ToleranceDistance=0, ToleranceAngle=0)  # -> Polyline, Segments
area_2 = Area(Geometry=curve_to_polyline.Polyline)  # -> flatten(Area), Centroid
buildable_area = BuildableArea(
    Parcels=clean_tree,
    Blocks=curve_to_polyline.Polyline,
    RoadSetback=road_face_setback_2,
    SideSetback=side_setback_2,
    BackSetback=back_setback_2,
    Tolerance=0.1)
mass_addition = MassAddition(Input=area_2.Area)  # -> Result, PartialResults
geometry = Geometry(buildable_area)
building_generation = BuildingGeneration(
    BuildableArea=geometry,
    Parcels=all_plots_including_open_space,
    Blocks=curve_to_polyline.Polyline,
    BuildingDepth=building_depth_2,
    BuildingLength=building_length_2,
    BuildingType=0,
    Location=area.Centroid,
    FAR=floor_area_ratio_far_2,
    FloorHeight=floor_height_2)  # -> BuildingFootprint, flatten(NumberOfFloors), BuildingHeight, FAR, flatten(GFA)
curve = Curve(building_generation.BuildingFootprint)
mass_addition_2 = MassAddition(Input=building_generation.GFA)  # -> Result, PartialResults
unit_z = UnitZ(Factor=building_generation.BuildingHeight)
extrude = Extrude(Base=curve, Direction=unit_z)
cap_holes = CapHoles(Brep=extrude)  # -> flatten(Brep)

# ----
boundary_surfaces = BoundarySurfaces(Edges=curve_to_polyline.Polyline)

boundary_surfaces_2 = BoundarySurfaces(Edges=site)
unit_z_2 = UnitZ(Factor=-0.1)
extrude_2 = Extrude(Base=boundary_surfaces, Direction=unit_z_2)
trim_solid = TrimSolid(Shape=boundary_surfaces_2, Cutters=extrude_2)
mesh_4 = Mesh(trim_solid)
mesh_colours_4 = MeshColours(Mesh=mesh_4, Colours=ColourSwatch(SwatchColor=RGB(153, 153, 153)))
context_bake_7 = ContextBake(Content=mesh_colours_4)

division_4 = Division(A=commercial_buildings_2, B=100)
division_5 = Division(A=residential_buildings_2, B=100)
random_split_list_3 = RandomSplitList(MasterList=cap_holes, Seed=alternatives_for_commercial_space_distri_2, Split=division_4)  # -> ListA, ListB
random_split_list_4 = RandomSplitList(MasterList=random_split_list_3.ListA, Seed=alternatives_for_residential_space_distr_2, Split=division_5)  # -> ListA, ListB
brep_4 = Brep(random_split_list_4.ListB)
brep_5 = Brep(random_split_list_4.ListA)
brep_6 = Brep(random_split_list_3.ListB)
mesh_5 = Mesh(brep_5)
mesh_6 = Mesh(brep_4)
mesh_7 = Mesh(brep_6)
mesh_colours_5 = MeshColours(Mesh=mesh_6, Colours=ColourSwatch(SwatchColor=RGB(246, 238, 64)))
mesh_colours_6 = MeshColours(Mesh=mesh_5, Colours=ColourSwatch(SwatchColor=RGB(247, 157, 64)))
mesh_colours_7 = MeshColours(Mesh=mesh_7, Colours=ColourSwatch(SwatchColor=RGB(45, 83, 255)))
context_bake_8 = ContextBake(CommercialBuildings=mesh_colours_7)
context_bake_9 = ContextBake(MixedUseBuildings=mesh_colours_6)
context_bake_10 = ContextBake(ResidentialBuildings=mesh_colours_5)
brep_edges = BrepEdges(Brep=[brep_6, brep_4, brep_5])  # -> Naked, Interior, NonManifold
curve_2 = Curve(brep_edges.Interior)
custom_preview_lineweights_2 = CustomPreviewLineweights(Geometry=curve_2, Shader=ColourSwatch(SwatchColor=RGB(0, 0, 0)), Thickness=1, Absolute=False)

# ---- group: Floor Generation
bounds = Bounds(Numbers=building_generation.NumberOfFloors)
deconstruct_domain = DeconstructDomain(Domain=bounds)  # -> Start, End
series = Series(Start=0, Step=floor_height_2, Count=deconstruct_domain.End)  # -> flatten(Series)
unit_z_3 = UnitZ(Factor=series)
xy_plane = XYPlane(Origin=unit_z_3)
bb_section = BBSection(Mesh=brep_5, Planes=xy_plane, Thickness=0, Deeper=0)
residential_floors = BBSection(Mesh=brep_4, Planes=xy_plane, Thickness=0, Deeper=0)
commercial_floors = BBSection(Mesh=brep_6, Planes=xy_plane, Thickness=0, Deeper=0)
area_3 = Area(Geometry=bb_section)  # -> Area, Centroid
area_4 = Area(Geometry=residential_floors)  # -> Area, Centroid
area_5 = Area(Geometry=commercial_floors)  # -> Area, Centroid

# ----
merge = Merge(Data1=commercial_floors, Data2=residential_floors, Data3=bb_section)
context_bake_11 = ContextBake(Content=merge)
custom_preview_lineweights_3 = CustomPreviewLineweights(Geometry=merge, Shader=ColourSwatch(SwatchColor=RGB(0, 0, 0)), Thickness=1, Absolute=False)
custom_preview_lineweights_4 = CustomPreviewLineweights(
    Geometry=[all_plots_including_open_space, geometry],
    Shader=ColourSwatch(SwatchColor=RGB(255, 14, 43)),
    Thickness=1,
    Absolute=False)
mesh_8 = Mesh(cap_holes)
mesh_colours_8 = MeshColours(Mesh=mesh_8, Colours=colour_rgb)

# ---- group: Area Calculation
area_6 = Area(Geometry=plots)  # -> Area, Centroid
clean_tree_2 = CleanTree(RemoveNulls=True, RemoveInvalid=True, RemoveEmpty=False, Tree=area_5.Area)  # -> flatten(Tree)
boundary_surfaces_3 = BoundarySurfaces(Edges=site)
area_7 = Area(Geometry=brep_3)  # -> Area, Centroid
area_8 = Area(Geometry=trim_solid)  # -> Area, Centroid
area_9 = Area(Geometry=brep_2)  # -> Area, Centroid
clean_tree_3 = CleanTree(RemoveNulls=True, RemoveInvalid=True, RemoveEmpty=False, Tree=area_6.Area)
mass_addition_3 = MassAddition(Input=clean_tree_2)  # -> Result, PartialResults
area_10 = Area(Geometry=boundary_surfaces_3)  # -> Area, Centroid
clean_tree_4 = CleanTree(RemoveNulls=True, RemoveInvalid=True, RemoveEmpty=False, Tree=area_4.Area)  # -> flatten(Tree)
clean_tree_5 = CleanTree(RemoveNulls=True, RemoveInvalid=True, RemoveEmpty=False, Tree=area_3.Area)  # -> flatten(Tree)
clean_tree_6 = CleanTree(RemoveNulls=True, RemoveInvalid=True, RemoveEmpty=False, Tree=area_7.Area)  # -> flatten(Tree)
clean_tree_7 = CleanTree(RemoveNulls=True, RemoveInvalid=True, RemoveEmpty=False, Tree=area_8.Area)  # -> flatten(Tree)
clean_tree_8 = CleanTree(RemoveNulls=True, RemoveInvalid=True, RemoveEmpty=False, Tree=area_9.Area)  # -> flatten(Tree)
mass_addition_4 = MassAddition(Input=clean_tree_3)  # -> flatten(Result), PartialResults
division_6 = Division(A=area_10.Area, B=10000)
round_to_decimal_place = RoundToDecimalPlace(NumberX=mass_addition_3.Result, DecimalPlace=0, RoundType=0)  # -> Rounded, Difference
mass_addition_5 = MassAddition(Input=clean_tree_4)  # -> Result, PartialResults
round_to_decimal_place_2 = RoundToDecimalPlace(NumberX=mass_addition_5.Result, DecimalPlace=0, RoundType=0)  # -> Rounded, Difference
round_to_decimal_place_3 = RoundToDecimalPlace(NumberX=clean_tree_7, DecimalPlace=0, RoundType=0)  # -> Rounded, Difference
mass_addition_6 = MassAddition(Input=clean_tree_8)  # -> Result, PartialResults
mass_addition_7 = MassAddition(Input=clean_tree_6)  # -> Result, PartialResults
mass_addition_8 = MassAddition(Input=clean_tree_5)  # -> Result, PartialResults
round_to_decimal_place_4 = RoundToDecimalPlace(NumberX=mass_addition_8.Result, DecimalPlace=0, RoundType=0)  # -> Rounded, Difference
multiplication_6 = Multiplication(A=division_6, B=150)
total_commercial_space_area = Panel(round_to_decimal_place.Rounded)
residential_space_area = Panel(clean_tree_4)
commercial_space_area = Panel(clean_tree_2)
mixed_use_space_area = Panel(clean_tree_5)
amenity_space_area = Panel(clean_tree_6)
road_area = Panel(round_to_decimal_place_3.Rounded)
total_residential_space_area = Panel(round_to_decimal_place_2.Rounded)
number_of_trees_to_be_planted = Panel(multiplication_6)
total_amenity_space_area = Panel(mass_addition_7.Result)
total_site_area = Panel(area_10.Area)
open_space_area = Panel(clean_tree_8)
total_open_space_area = Panel(mass_addition_6.Result)
plot_area = Panel(clean_tree_3)
total_sellable_plot_area = Panel(mass_addition_4.Result)
total_mixed_use_space_area = Panel(round_to_decimal_place_4.Rounded)
text_5 = Text("sq.m.")
text_6 = Text("sq.m.")
text_7 = Text("sq.m.")
round_to_decimal_place_5 = RoundToDecimalPlace(NumberX=area_10.Area, DecimalPlace=0, RoundType=0)  # -> Rounded, Difference
round_to_decimal_place_6 = RoundToDecimalPlace(NumberX=mass_addition_7.Result, DecimalPlace=0, RoundType=0)  # -> Rounded, Difference
round_to_decimal_place_7 = RoundToDecimalPlace(NumberX=mass_addition_6.Result, DecimalPlace=0, RoundType=0)  # -> Rounded, Difference
round_to_decimal_place_8 = RoundToDecimalPlace(NumberX=total_sellable_plot_area, DecimalPlace=0, RoundType=0)  # -> Rounded, Difference
concatenate = Concatenate(FragmentA=round_to_decimal_place.Rounded, FragmentB=text_5)
concatenate_2 = Concatenate(FragmentA=round_to_decimal_place_4.Rounded, FragmentB=text_6)
concatenate_3 = Concatenate(FragmentA=round_to_decimal_place_2.Rounded, FragmentB=text_7)
text_8 = Text("sq.m.")
text_9 = Text("sq.m.")
text_10 = Text("sq.m.")
text_11 = Text("sq.m.")
text_12 = Text("sq.m.")
total_mixed_use_space_area_2 = Panel(concatenate_2)
concatenate_4 = Concatenate(FragmentA=road_area, FragmentB=text_8)
total_residential_space_area_2 = Panel(concatenate_3)
total_commercial_space_area_2 = Panel(concatenate)
concatenate_5 = Concatenate(FragmentA=round_to_decimal_place_5.Rounded, FragmentB=text_9)
concatenate_6 = Concatenate(FragmentA=round_to_decimal_place_6.Rounded, FragmentB=text_10)
concatenate_7 = Concatenate(FragmentA=round_to_decimal_place_7.Rounded, FragmentB=text_11)
concatenate_8 = Concatenate(FragmentA=round_to_decimal_place_8.Rounded, FragmentB=text_12)
road_area_2 = Panel(concatenate_4)
total_amenity_space_area_2 = Panel(concatenate_6)
total_site_area_2 = Panel(concatenate_5)
total_open_space_area_2 = Panel(concatenate_7)
total_sellable_plot_area_2 = Panel(concatenate_8)
text_13 = Text("sq.m.")
multiplication_7 = Multiplication(A=round_to_decimal_place_5.Rounded, B=0.000247105)
text_14 = Text(" Acre")
round_to_decimal_place_9 = RoundToDecimalPlace(NumberX=multiplication_7, DecimalPlace=0, RoundType=0)  # -> Rounded, Difference
concatenate_9 = Concatenate(FragmentA=round_to_decimal_place_9.Rounded, FragmentB=text_14)
total_site_area_3 = Panel(concatenate_9)

# ----
addition = Addition(A=mass_addition_3.Result, B=mass_addition_8.Result, C=mass_addition_5.Result)

# ---- group: Area Calculation (continued)
round_to_decimal_place_10 = RoundToDecimalPlace(NumberX=addition, DecimalPlace=0, RoundType=0)  # -> Rounded, Difference
total_developable_area = Panel(round_to_decimal_place_10.Rounded)
concatenate_10 = Concatenate(FragmentA=round_to_decimal_place_10.Rounded, FragmentB=text_13)
total_developable_area_2 = Panel(concatenate_10)

# ----
percentage = Percentage(Number=clean_tree_5, Percent=80)
percentage_2 = Percentage(Number=clean_tree_5, Percent=20)
multiplication_8 = Multiplication(A=clean_tree_2, B=multiplication_4)
multiplication_9 = Multiplication(A=clean_tree_4, B=multiplication_5)
multiplication_10 = Multiplication(A=mass_addition_5.Result, B=multiplication_5)
percentage_3 = Percentage(Number=mass_addition_8.Result, Percent=80)
multiplication_11 = Multiplication(A=mass_addition_3.Result, B=multiplication_4)
percentage_4 = Percentage(Number=mass_addition_8.Result, Percent=20)
multiplication_12 = Multiplication(A=total_sellable_plot_area, B=multiplication_2)
multiplication_13 = Multiplication(A=plot_area, B=multiplication_3)
round = Round(Number=multiplication_8)  # -> Nearest, Floor, Ceiling
multiplication_14 = Multiplication(A=percentage, B=multiplication_5)
multiplication_15 = Multiplication(A=percentage_2, B=multiplication_4)
round_to_decimal_place_11 = RoundToDecimalPlace(NumberX=multiplication_10, DecimalPlace=0, RoundType=0)  # -> Rounded, Difference
round_to_decimal_place_12 = RoundToDecimalPlace(NumberX=multiplication_11, DecimalPlace=0, RoundType=0)  # -> Rounded, Difference
round_2 = Round(Number=multiplication_9)  # -> Nearest, Floor, Ceiling
multiplication_16 = Multiplication(A=percentage_4, B=multiplication_4)
multiplication_17 = Multiplication(A=percentage_3, B=multiplication_5)
round_3 = Round(Number=multiplication_12)  # -> Nearest, Floor, Ceiling
round_4 = Round(Number=multiplication_13)  # -> Nearest, Floor, Ceiling
addition_2 = Addition(A=multiplication_15, B=multiplication_14)
round_to_decimal_place_13 = RoundToDecimalPlace(NumberX=addition_2, DecimalPlace=0, RoundType=0)  # -> Rounded, Difference
addition_3 = Addition(A=multiplication_16, B=multiplication_17)
round_to_decimal_place_14 = RoundToDecimalPlace(NumberX=addition_3, DecimalPlace=0, RoundType=0)  # -> Rounded, Difference
market_price_of_commercial_space = Panel(round.Nearest)
total_market_price_of_commercial_space = Panel(round_to_decimal_place_12.Rounded)
market_price_of_mixed_use_space = Panel(round_to_decimal_place_13.Rounded)
total_market_price_of_residential_space = Panel(round_to_decimal_place_11.Rounded)
total_market_price_of_mixed_use_space = Panel(round_to_decimal_place_14.Rounded)
market_price_of_residential_space = Panel(round_2.Nearest)
market_price_of_plots = Panel(round_4.Nearest)
market_price_of_plots_2 = Panel(round_3.Nearest)
addition_4 = Addition(A=round_to_decimal_place_12.Rounded, B=round_to_decimal_place_11.Rounded, C=round_to_decimal_place_14.Rounded)
division_7 = Division(A=round_to_decimal_place_12.Rounded, B=10000000)
division_8 = Division(A=round_to_decimal_place_11.Rounded, B=10000000)
division_9 = Division(A=round_to_decimal_place_14.Rounded, B=10000000)
round_to_decimal_place_15 = RoundToDecimalPlace(NumberX=addition_4, DecimalPlace=0, RoundType=0)  # -> Rounded, Difference
round_to_decimal_place_16 = RoundToDecimalPlace(NumberX=division_7, DecimalPlace=1, RoundType=0)  # -> Rounded, Difference
round_to_decimal_place_17 = RoundToDecimalPlace(NumberX=division_8, DecimalPlace=0, RoundType=0)  # -> Rounded, Difference
round_to_decimal_place_18 = RoundToDecimalPlace(NumberX=division_9, DecimalPlace=0, RoundType=0)  # -> Rounded, Difference
concatenate_11 = Concatenate(FragmentA=round_to_decimal_place_17.Rounded, FragmentB=text_2)
concatenate_12 = Concatenate(FragmentA=round_to_decimal_place_16.Rounded, FragmentB=text)
concatenate_13 = Concatenate(FragmentA=round_to_decimal_place_18.Rounded, FragmentB=text_3)
total_market_price_of_development = Panel(round_to_decimal_place_15.Rounded)
total_market_price_of_commercial_space_2 = Panel(concatenate_12)
total_market_price_of_residential_space_2 = Panel(concatenate_11)
total_market_price_of_mixed_use_space_2 = Panel(concatenate_13)
division_10 = Division(A=round_to_decimal_place_15.Rounded, B=10000000)
round_to_decimal_place_19 = RoundToDecimalPlace(NumberX=division_10, DecimalPlace=0, RoundType=0)  # -> Rounded, Difference
total_market_price = Number(round_to_decimal_place_19.Rounded)
concatenate_14 = Concatenate(FragmentA=round_to_decimal_place_19.Rounded, FragmentB=text_4)
total_market_price_of_development_2 = Panel(concatenate_14)

# ---- group: Cost Calculation
multiplication_18 = Multiplication(A=765, B=10.7639)
multiplication_19 = Multiplication(A=5, B=10.7639, C=round_to_decimal_place_3.Rounded)
multiplication_20 = Multiplication(A=2000, B=10.7639, C=round_to_decimal_place_10.Rounded)
division_11 = Division(A=multiplication_19, B=10000000)
division_12 = Division(A=multiplication_20, B=10000000)
multiplication_21 = Multiplication(A=round_to_decimal_place_5.Rounded, B=multiplication_18)
round_to_decimal_place_20 = RoundToDecimalPlace(NumberX=division_11, DecimalPlace=1, RoundType=0)  # -> Rounded, Difference
round_to_decimal_place_21 = RoundToDecimalPlace(NumberX=division_12, DecimalPlace=1, RoundType=0)  # -> Rounded, Difference
division_13 = Division(A=multiplication_21, B=10000000)
round_5 = Round(Number=division_13)  # -> Nearest, Floor, Ceiling
text_15 = Text("Cr.")
text_16 = Text("Cr.")
text_17 = Text("Cr.")
concatenate_15 = Concatenate(FragmentA=round_to_decimal_place_20.Rounded, FragmentB=text_15)
concatenate_16 = Concatenate(FragmentA=round_to_decimal_place_21.Rounded, FragmentB=text_16)
text_18 = Text("Cr.")
road_cost = Panel(concatenate_15)
construction_cost = Panel(concatenate_16)
concatenate_17 = Concatenate(FragmentA=round_5.Nearest, FragmentB=text_18)
land_cost = Panel(concatenate_17)

# ----
addition_5 = Addition(A=round_5.Nearest, B=round_to_decimal_place_21.Rounded, C=round_to_decimal_place_20.Rounded)

# ---- group: Cost Calculation (continued)
concatenate_18 = Concatenate(FragmentA=addition_5, FragmentB=text_17)
total_cost = Panel(concatenate_18)

# ----
total_cost_2 = Number(addition_5)
subtraction = Subtraction(A=total_market_price, B=total_cost_2)
capital_gain = Number(subtraction)
division_14 = Division(A=capital_gain, B=total_cost_2)
multiplication_22 = Multiplication(A=division_14, B=100)
round_to_decimal_place_22 = RoundToDecimalPlace(NumberX=multiplication_22, DecimalPlace=1, RoundType=0)  # -> Rounded, Difference
concatenate_19 = Concatenate(FragmentA=round_to_decimal_place_22.Rounded, FragmentB="%")
roi = Panel(concatenate_19)

# ---- group: output
curve_3 = Curve(<curve referenced from the Rhino model>)
divide_curve = DivideCurve(Curve=curve_3, Count=10, Kinks=False)  # -> reverse(Points), Tangents, Parameters
list_item = ListItem(List=divide_curve.Points, Index=0, Wrap=True)
list_item_2 = ListItem(List=divide_curve.Points, Index=3, Wrap=True)
list_item_3 = ListItem(List=divide_curve.Points, Index=6, Wrap=True)
list_item_4 = ListItem(List=divide_curve.Points, Index=9, Wrap=True)
list_item_5 = ListItem(List=divide_curve.Points, Index=8, Wrap=True)
list_item_6 = ListItem(List=divide_curve.Points, Index=5, Wrap=True)
list_item_7 = ListItem(List=divide_curve.Points, Index=2, Wrap=True)
list_item_8 = ListItem(List=divide_curve.Points, Index=7, Wrap=True)
list_item_9 = ListItem(List=divide_curve.Points, Index=1, Wrap=True)
list_item_10 = ListItem(List=divide_curve.Points, Index=4, Wrap=True)
geometry_2 = Geometry(list_item)
geometry_3 = Geometry(list_item_2)
geometry_4 = Geometry(list_item_3)
geometry_5 = Geometry(list_item_6)
geometry_6 = Geometry(list_item_4)
geometry_7 = Geometry(list_item_5)
geometry_8 = Geometry(list_item_7)
geometry_9 = Geometry(list_item_8)
geometry_10 = Geometry(list_item_10)
geometry_11 = Geometry(list_item_9)
text_19 = Text("Site Area ")
text_20 = Text(concatenate_9)
text_21 = Text("Road Cost ")
text_22 = Text(concatenate_15)
text_23 = Text("Total Cost ")
text_24 = Text("ROI ")
text_25 = Text(concatenate_19)
text_26 = Text(concatenate_18)
text_27 = Text("Commercial Space Price")
text_28 = Text("Construction Cost ")
text_29 = Text(concatenate_16)
text_30 = Text("Market Price ")
text_31 = Text("Land Cost ")
text_32 = Text(concatenate_14)
text_33 = Text(concatenate_17)
text_34 = Text(concatenate_12)
text_35 = Text("Mixed-Use Space Price")
text_36 = Text(concatenate_13)
text_37 = Text("Residential Space Price ")
text_38 = Text(concatenate_11)
concatenate_20 = Concatenate(FragmentA=text_19, FragmentB=text_20)
concatenate_21 = Concatenate(FragmentA=text_21, FragmentB=text_22)
colour_swatch = ColourSwatch(SwatchColor=RGB(255, 255, 255))
concatenate_22 = Concatenate(FragmentA=text_24, FragmentB=text_25)
concatenate_23 = Concatenate(FragmentA=text_23, FragmentB=text_26)
concatenate_24 = Concatenate(FragmentA=text_28, FragmentB=text_29)
concatenate_25 = Concatenate(FragmentA=text_30, FragmentB=text_32)
concatenate_26 = Concatenate(FragmentA=text_31, FragmentB=text_33)
colour_swatch_2 = ColourSwatch(SwatchColor=RGB(255, 255, 255))
concatenate_27 = Concatenate(FragmentA=text_27, FragmentB=text_34)
concatenate_28 = Concatenate(FragmentA=text_35, FragmentB=text_36)
concatenate_29 = Concatenate(FragmentA=text_37, FragmentB=text_38)
text_tag = TextTag(Location=geometry_6, Text=concatenate_21, Colour=colour_swatch)
text_tag_2 = TextTag(Location=geometry_11, Text=concatenate_22, Colour=colour_swatch)
text_tag_3 = TextTag(Location=geometry_4, Text=concatenate_23, Colour=colour_swatch)
text_tag_4 = TextTag(Location=geometry_7, Text=concatenate_24, Colour=colour_swatch)
text_tag_5 = TextTag(Location=geometry_2, Text=concatenate_20, Colour=colour_swatch)
text_tag_6 = TextTag(Location=geometry_8, Text=concatenate_25, Colour=colour_swatch)
text_tag_7 = TextTag(Location=geometry_9, Text=concatenate_26, Colour=colour_swatch)
text_tag_8 = TextTag(Location=geometry_10, Text=concatenate_29, Colour=colour_swatch_2)
text_tag_9 = TextTag(Location=geometry_3, CommercialSpace=concatenate_27, Colour=colour_swatch_2)
text_tag_10 = TextTag(Location=geometry_5, Text=concatenate_28, Colour=colour_swatch_2)
curve_4 = Curve(<curve referenced from the Rhino model>)
divide_curve_2 = DivideCurve(Curve=curve_4, Count=9, Kinks=False)  # -> reverse(Points), Tangents, Parameters
list_item_11 = ListItem(List=divide_curve_2.Points, Index=1, Wrap=True)
list_item_12 = ListItem(List=divide_curve_2.Points, Index=8, Wrap=True)
list_item_13 = ListItem(List=divide_curve_2.Points, Index=2, Wrap=True)
list_item_14 = ListItem(List=divide_curve_2.Points, Index=0, Wrap=True)
list_item_15 = ListItem(List=divide_curve_2.Points, Index=6, Wrap=True)
list_item_16 = ListItem(List=divide_curve_2.Points, Index=7, Wrap=True)
list_item_17 = ListItem(List=divide_curve_2.Points, Index=5, Wrap=True)
list_item_18 = ListItem(List=divide_curve_2.Points, Index=3, Wrap=True)
list_item_19 = ListItem(List=divide_curve_2.Points, Index=4, Wrap=True)
geometry_12 = Geometry(list_item_11)
geometry_13 = Geometry(list_item_13)
geometry_14 = Geometry(list_item_12)
geometry_15 = Geometry(list_item_14)
geometry_16 = Geometry(list_item_15)
geometry_17 = Geometry(list_item_16)
geometry_18 = Geometry(list_item_17)
geometry_19 = Geometry(list_item_18)
geometry_20 = Geometry(list_item_19)
text_39 = Text("Road Area ")
text_40 = Text("Developable Area ")
sellable_plot_area = Text("Sellable Plot Area ")
text_41 = Text(concatenate_4)
text_42 = Text(concatenate_10)
text_43 = Text("Trees to be planted min. ")
text_44 = Text(multiplication_6)
text_45 = Text(concatenate_8)
text_46 = Text("Amenity Space ")
text_47 = Text("Open Space ")
text_48 = Text(concatenate_6)
text_49 = Text(concatenate_7)
text_50 = Text("Mixed-Use Space ")
text_51 = Text(concatenate_2)
text_52 = Text("Commercial Space ")
text_53 = Text(concatenate)
text_54 = Text("Residential Space ")
text_55 = Text(concatenate_3)
concatenate_30 = Concatenate(FragmentA=text_39, FragmentB=text_41)
concatenate_31 = Concatenate(FragmentA=text_43, FragmentB=text_44)
concatenate_32 = Concatenate(FragmentA=text_40, FragmentB=text_42)
concatenate_33 = Concatenate(FragmentA=text_46, FragmentB=text_48)
concatenate_34 = Concatenate(FragmentA=text_47, FragmentB=text_49)
concatenate_35 = Concatenate(FragmentA=sellable_plot_area, FragmentB=text_45)
concatenate_36 = Concatenate(FragmentA=text_50, FragmentB=text_51)
concatenate_37 = Concatenate(FragmentA=text_52, FragmentB=text_53)
concatenate_38 = Concatenate(FragmentA=text_54, FragmentB=text_55)
text_tag_11 = TextTag(Location=geometry_12, Text=concatenate_30, Colour=colour_swatch)
text_tag_12 = TextTag(Location=geometry_14, Text=concatenate_31, Colour=colour_swatch)
text_tag_13 = TextTag(Location=geometry_13, Text=concatenate_32, Colour=colour_swatch)
text_tag_14 = TextTag(Location=geometry_16, Text=concatenate_33, Colour=colour_swatch)
text_tag_15 = TextTag(Location=geometry_17, Text=concatenate_34, Colour=colour_swatch)
text_tag_16 = TextTag(Location=geometry_15, Text=concatenate_35, Colour=colour_swatch)
text_tag_17 = TextTag(Location=geometry_18, Text=concatenate_36, Colour=colour_swatch)
text_tag_18 = TextTag(Location=geometry_19, Text=concatenate_37, Colour=colour_swatch)
text_tag_19 = TextTag(Location=geometry_20, Text=concatenate_38, Colour=colour_swatch)

# ----
context_bake_12 = ContextBake(ConstructionCost=concatenate_24)
context_bake_13 = ContextBake(RoadCost=concatenate_21)
context_bake_14 = ContextBake(LandCost=concatenate_26)
context_bake_15 = ContextBake(SiteArea=concatenate_20)
context_bake_16 = ContextBake(MarketPrice=concatenate_25)
context_bake_17 = ContextBake(Content=concatenate_22)
context_bake_18 = ContextBake(TotalCost=concatenate_23)
context_bake_19 = ContextBake(ResidentialSpacePrice=concatenate_29)
context_bake_20 = ContextBake(CommercialSpacePrice=concatenate_27)
context_bake_21 = ContextBake(MixedUseSpacePrice=concatenate_28)
context_bake_22 = ContextBake(OpenSpaceArea=concatenate_34)
context_bake_23 = ContextBake(AmenitySpaceArea=concatenate_33)
context_bake_24 = ContextBake(RoadArea=concatenate_30)
context_bake_25 = ContextBake(TreesToBePlantedMin=concatenate_31)
context_bake_26 = ContextBake(DevelopableArea=concatenate_32)
context_bake_27 = ContextBake(MixedUseSpace=concatenate_36)
context_bake_28 = ContextBake(CommercialSpace=concatenate_37)
context_bake_29 = ContextBake(SellablePlotArea=concatenate_35)
context_bake_30 = ContextBake(ResidentialSpace=concatenate_38)

# ==== cluster CustomEdgeWeights: Creates lits for custom edge weighting. Each line segment can be assigned either custom or general weight. segments with custom weights are identifyied via custom weight point list
segments = ClusterInput()
pointsofinterest = ClusterInput()
customweights = ClusterInput()
generalweight = ClusterInput()
segments_2 = Line(segments)
generalweight_2 = Number(generalweight)
customweights_2 = Number(customweights)
pointsofinterest_2 = Point(pointsofinterest)
lng = ListLength(List=segments_2)
crv_cp = CurveClosestPoint(Point=graft(pointsofinterest_2), Curve=segments_2)  # -> Point, Parameter, Distance
series = Series(Start=0, Step=1, Count=lng)
sort = SortList(Keys=crv_cp.Distance, ValuesA=series)  # -> Keys, ValuesA
item = ListItem(List=sort.ValuesA, Index=0, Wrap=True)  # -> flatten(Item)
lng_2 = ListLength(List=item)
dup = DuplicateData(Data=customweights_2, Number=lng_2, Order=True)
c_script = CSharpScript(x=customweights_2, y=dup)  # -> out, A; inputs x: list of Double, y: list of Double
# ---------- c_script: C# usings ----------
using System.IO;
using System.Linq;
using System.Data;
using System.Drawing;
using System.Reflection;
using System.Windows.Forms;
using System.Xml;
using System.Xml.Linq;
using System.Runtime.InteropServices;

using Rhino.DocObjects;
using Rhino.Collections;
using GH_IO;
using GH_IO.Serialization;
# ---------- c_script: C# ----------
    if(x.Count == 1)
      A = y;
    else
      A = x;
# ---------- end c_script ----------
ids = Integer(item)
c_list = CSharpScript(edge_count=lng, ids=ids, weights=c_script.A, general_weight=generalweight_2)  # -> add_weight; inputs edge_count: Int32, ids: list of Int32, weights: list of Double, general_weight: Double
# ---------- c_list: C# ----------
    List<double> result = new List<double>(); //Enumerable.Repeat(general_weight, edge_count).ToList();

    for (int i = 0; i < edge_count * 2; i++)
    {
      result.Add(general_weight);
    }


    for (int i = 0; i < ids.Count; i++)
    {
      result[ids[i]*2] = weights[i];
      result[ids[i]*2 + 1] = weights[i];
    }

    add_weight = result;
# ---------- end c_list ----------
weight_list = Number(c_list)
weight_list_2 = ClusterOutput(weight_list)
