# Grasshopper definition final_building_6.gh (Grasshopper 1.0.7)
# plug-ins: DeCodingSpaces, Bifocals, Bowerbird2, Human, LunchBox, RhinoCodePluginGH, Pufferfish

no_of_random_angle = Slider(4, range=1..60)

alternatives_for_commercial_space_distri = Slider(100, range=0..100)  # "Alternatives for Commercial Space distribution"
alternatives_for_amenity_space_distribut = Slider(19, range=0..50)  # "Alternatives for Amenity Space distribution"
alternatives_for_residential_space_distr = Slider(26, range=0..50)  # "Alternatives for Residential Space distribution"
open_space = Slider(20, range=20..100)
amenity_space = Slider(10, range=5..100)
alternatives_for_open_space_distribution = Slider(10, range=0..50)
commercial_buildings = Slider(30, range=0..100)
residential_buildings = Slider(35, range=0..100)
min_length_of_street_segment = Slider(21, range=0..100)
floor_area_ratio_far = Slider(3.4, range=0.5..7)
max_length_of_street_segment = Slider(255, range=0..350)
building_length = Slider(19, range=3..100)
building_depth = Slider(21, range=3..100)
floor_height = Slider(3, range=3..4.5)
side_setback = Slider(1, range=1..6)
back_setback = Slider(1, range=1..6)
max_plot_area = Slider(700, range=700..400000)
depth_of_street_hierarchy = Slider(1, range=0..60)
street_width = Slider(9, range=9..20)
site_boundary = Curve(<curve referenced from the Rhino model>)
initial_streets = Curve([<curve referenced from the Rhino model> x8])
min_plot_width = Slider(29, range=20..100)
road_face_setback = Slider(3, range=3..6)

panel = Panel("INPUTS")
alternatives_for_open_space_distribution_2 = GetNumber(
    alternatives_for_open_space_distribution,
    AtLeast=1,
    AtMost=1,
    Maximum=1.797693135e+308,
    Minimum=-1.797693135e+308,
    TreeAccess=False)
street_width_2 = GetNumber(street_width, AtLeast=1, AtMost=1, Maximum=1.797693135e+308, Minimum=-1.797693135e+308, TreeAccess=False)
min_plot_width_2 = GetNumber(min_plot_width, AtLeast=1, AtMost=1, Maximum=1.797693135e+308, Minimum=-1.797693135e+308, TreeAccess=False)
alternatives_for_commercial_space_distri_2 = GetNumber(
    alternatives_for_commercial_space_distri,
    AtLeast=1,
    AtMost=1,
    Maximum=1.797693135e+308,
    Minimum=-1.797693135e+308,
    TreeAccess=False)  # "Alternatives for commercial space distribution"
alternatives_for_amenity_space_distribut_2 = GetNumber(
    alternatives_for_amenity_space_distribut,
    AtLeast=1,
    AtMost=1,
    Maximum=1.797693135e+308,
    Minimum=-1.797693135e+308,
    TreeAccess=False)  # "Alternatives for Amenity space distribution"
building_depth_2 = GetNumber(building_depth, AtLeast=1, AtMost=1, Maximum=1.797693135e+308, Minimum=-1.797693135e+308, TreeAccess=False)
back_setback_2 = GetNumber(back_setback, AtLeast=1, AtMost=1, Maximum=1.797693135e+308, Minimum=-1.797693135e+308, TreeAccess=False)
commercial_buildings_2 = GetNumber(commercial_buildings, AtLeast=1, AtMost=1, Maximum=1.797693135e+308, Minimum=-1.797693135e+308, TreeAccess=False)
residential_buildings_2 = GetNumber(residential_buildings, AtLeast=1, AtMost=1, Maximum=1.797693135e+308, Minimum=-1.797693135e+308, TreeAccess=False)
side_setback_2 = GetNumber(side_setback, AtLeast=1, AtMost=1, Maximum=1.797693135e+308, Minimum=-1.797693135e+308, TreeAccess=False)
amenity_space_2 = GetNumber(amenity_space, AtLeast=1, AtMost=1, Maximum=1.797693135e+308, Minimum=-1.797693135e+308, TreeAccess=False)
min_length_of_street_segment_2 = GetNumber(min_length_of_street_segment, AtLeast=1, AtMost=1, Maximum=1.797693135e+308, Minimum=-1.797693135e+308, TreeAccess=False)
max_plot_area_2 = GetNumber(max_plot_area, AtLeast=1, AtMost=1, Maximum=1.797693135e+308, Minimum=-1.797693135e+308, TreeAccess=False)
road_face_setback_2 = GetNumber(road_face_setback, AtLeast=1, AtMost=1, Maximum=1.797693135e+308, Minimum=-1.797693135e+308, TreeAccess=False)
building_length_2 = GetNumber(building_length, AtLeast=1, AtMost=1, Maximum=1.797693135e+308, Minimum=-1.797693135e+308, TreeAccess=False)
max_length_of_street_segment_2 = GetNumber(max_length_of_street_segment, AtLeast=1, AtMost=1, Maximum=1.797693135e+308, Minimum=-1.797693135e+308, TreeAccess=False)
floor_area_ratio_far_2 = GetNumber(floor_area_ratio_far, AtLeast=1, AtMost=1, Maximum=1.797693135e+308, Minimum=-1.797693135e+308, TreeAccess=False)
floor_height_2 = GetNumber(floor_height, AtLeast=1, AtMost=1, Maximum=1.797693135e+308, Minimum=-1.797693135e+308, TreeAccess=False)
open_space_2 = GetNumber(open_space, AtLeast=1, AtMost=1, Maximum=1.797693135e+308, Minimum=-1.797693135e+308, TreeAccess=False)
depth_of_street_hierarchy_2 = GetNumber(depth_of_street_hierarchy, AtLeast=1, AtMost=1, Maximum=1.797693135e+308, Minimum=-1.797693135e+308, TreeAccess=False)
alternatives_for_residential_space_distr_2 = GetNumber(
    alternatives_for_residential_space_distr,
    AtLeast=1,
    AtMost=1,
    Maximum=1.797693135e+308,
    Minimum=-1.797693135e+308,
    TreeAccess=False)  # "Alternatives for residential space distribution"
no_of_random_angle_2 = GetNumber(no_of_random_angle, AtLeast=1, AtMost=1, Maximum=1.797693135e+308, Minimum=-1.797693135e+308, TreeAccess=False)
custom_preview_lineweights = CustomPreviewLineweights(Geometry=site_boundary, Shader=ColourSwatch(SwatchColor=RGB(255, 14, 43)), Thickness=5, Absolute=False)
custom_edge_weights = CustomEdgeWeights()
mesh = Mesh()
multiplication = Multiplication(A=765, B=10.7639)
multiplication_2 = Multiplication(A=765, B=10.7639)
multiplication_3 = Multiplication(A=17391, B=10.7639)
multiplication_4 = Multiplication(A=10018, B=10.7639)
text = Text("Cr.")
text_2 = Text("Cr.")
text_3 = Text("Cr.")
text_4 = Text("Cr.")
panel_2 = Panel("OUTPUTS")
addition = Addition(A=open_space, B=amenity_space, C=commercial_buildings, D=residential_buildings)
subtraction = Subtraction(A=100, B=addition)
concatenate = Concatenate(A="(", Fragment_A=open_space_2, Fragment_B="%)")
concatenate_2 = Concatenate(A="(", Fragment_A=residential_buildings_2, Fragment_B="%)")
concatenate_3 = Concatenate(A="(", Fragment_A=amenity_space_2, Fragment_B="%)")
concatenate_4 = Concatenate(A="(", Fragment_A=commercial_buildings_2, Fragment_B="%)")
concatenate_5 = Concatenate(A="(", Fragment_A=subtraction, Fragment_B="%)")

# ---- group: Massing Generation
streetnetworksynthesist = StreetNetworkSynthesisT(
    Boundary=site_boundary,
    IniStreets=initial_streets,
    MinLength=min_length_of_street_segment_2,
    MaxLength=max_length_of_street_segment_2,
    MinDist=40,
    RandomAngle=no_of_random_angle_2,
    MaxArms=2,
    TreeDepth=depth_of_street_hierarchy_2)
road_network = Geometry(streetnetworksynthesist)
panel_3 = Panel("MAIN STREET NETWORK")
division = Division(A=street_width_2, B=2)
site_division = PolygonsFromLines(Lines=road_network, MinBlockSize=0)  # -> Polygons, SynchronizedValues
offset_curve = Offset(Curve=site_division.Polygons, Distance=division, Plane=PlaneXY(0, 0, 0), Corners=1)  # -> flatten(Curve)
parcels = Parcels(
    Polygons=site_division.Polygons,
    MaxParcelArea=max_plot_area_2,
    ConnectionDistance=division,
    StreetOffset=min_plot_width_2)
curve_to_polyline = CurveToPolyline(Curve=offset_curve, ToleranceDistance=0, ToleranceAngle=0)  # -> Polyline, Segments
panel_4 = Panel("Plots")
all_plots_including_open_space = Geometry(parcels)
panel_5 = Panel("Blocks")
area = Area(Geometry=curve_to_polyline.Polyline)  # -> flatten(Area), Centroid
area_2 = Area(Geometry=all_plots_including_open_space)  # -> flatten(Area), Centroid
mass_addition = MassAddition(Input=area.Area)  # -> Result, PartialResults
panel_6 = Panel("Building Footprint")
panel_7 = Panel("Building Mass Configuration")

# ----
boundary_surfaces = BoundarySurfaces(Edges=curve_to_polyline.Polyline)

# ---- group: Roads
boundary_surfaces_2 = BoundarySurfaces(Edges=site_boundary)
unit_z = UnitZ(Factor=-0.1)
extrude = Extrude(Base=boundary_surfaces, Direction=unit_z)
trim_solid = TrimSolid(Shape=boundary_surfaces_2, Cutters=extrude)
custom_preview = CustomPreview(Geometry=trim_solid, Material=ColourSwatch(SwatchColor=RGB(153, 153, 153)))

# ----
context_bake = ContextBake(Content=trim_solid)

division_2 = Division(A=commercial_buildings_2, B=100)
division_3 = Division(A=residential_buildings_2, B=100)

brep = Brep(flatten(all_plots_including_open_space))
list_length = ListLength(List=brep)
panel_8 = Panel(brep)
division_4 = Division(A=open_space_2, B=100)
division_5 = Division(A=amenity_space_2, B=100)
random_split_list = RandomSplitList(MasterList=brep, Seed=alternatives_for_open_space_distribution_2, Split=division_4)  # -> ListA, ListB
random_split_list_2 = RandomSplitList(MasterList=random_split_list.ListA, Seed=alternatives_for_amenity_space_distribut_2, Split=division_5)  # -> ListA, ListB
plots = Geometry(random_split_list_2.ListA)
brep_2 = Brep(random_split_list.ListB)
brep_3 = Brep(random_split_list_2.ListB)

all_plots = Geometry(plots)

# ---- group: Massing Generation (continued)
buildable_area = BuildableArea(
    Parcels=all_plots,
    Blocks=curve_to_polyline.Polyline,
    RoadSetback=road_face_setback_2,
    SideSetback=side_setback_2,
    BackSetback=back_setback_2,
    Tolerance=0.1)
geometry = Geometry(buildable_area)
building_generation = BuildingGeneration(
    BuildableArea=geometry,
    Parcels=all_plots_including_open_space,
    Blocks=curve_to_polyline.Polyline,
    BuildingDepth=building_depth_2,
    BuildingLength=building_length_2,
    BuildingType=0,
    Location=area_2.Centroid,
    FAR=floor_area_ratio_far_2,
    FloorHeight=floor_height_2)  # -> BuildingFootprint, flatten(NumberOfFloors), BuildingHeight, FAR, flatten(GFA)
curve = Curve(building_generation.BuildingFootprint)
mass_addition_2 = MassAddition(Input=building_generation.GFA)  # -> Result, PartialResults
unit_z_2 = UnitZ(Factor=building_generation.BuildingHeight)
extrude_2 = Extrude(Base=curve, Direction=unit_z_2)
cap_holes = CapHoles(Brep=extrude_2)  # -> flatten(Brep)

# ----
mesh_2 = Mesh(cap_holes)
context_bake_2 = ContextBake(Content=[all_plots_including_open_space, geometry])
custom_preview_lineweights_2 = CustomPreviewLineweights(
    Geometry=[all_plots_including_open_space, geometry],
    Shader=ColourSwatch(SwatchColor=RGB(255, 14, 43)),
    Thickness=1,
    Absolute=False)
mesh_3 = Mesh(random_split_list_2.ListA)
mesh_4 = Mesh(brep_2)
mesh_5 = Mesh(brep_3)

custom_preview_2 = CustomPreview(Geometry=mesh_3, Material=ColourSwatch(SwatchColor=RGB(94, 57, 0)))
custom_preview_3 = CustomPreview(Geometry=mesh_4, Material=ColourSwatch(SwatchColor=RGB(127, 214, 0)))
custom_preview_4 = CustomPreview(Geometry=mesh_5, Material=ColourSwatch(SwatchColor=RGB(106, 196, 203)))

context_bake_3 = ContextBake(BuildablePlots=mesh_3)
context_bake_4 = ContextBake(OpenSpace=mesh_4)
context_bake_5 = ContextBake(AmenitySpace=mesh_5)
number_of_floors = Panel(building_generation.NumberOfFloors)
gross_floor_area_gfa = Panel(building_generation.GFA)
building_heights = Panel(building_generation.BuildingHeight)
total_gross_floor_area_gfa = Panel(mass_addition_2.Result)

# ---- group: Floor Generation
bounds = Bounds(Numbers=building_generation.NumberOfFloors)
deconstruct_domain = DeconstructDomain(Domain=bounds)  # -> Start, End
series = Series(Start=0, Step=floor_height_2, Count=deconstruct_domain.End)  # -> flatten(Series)
unit_z_3 = UnitZ(Factor=series)
xy_plane = XYPlane(Origin=unit_z_3)

# ----
concatenate_6 = Concatenate(FragmentA="Level - ", FragmentB=series)

random_split_list_3 = RandomSplitList(MasterList=cap_holes, Seed=alternatives_for_commercial_space_distri_2, Split=division_2)  # -> ListA, ListB
random_split_list_4 = RandomSplitList(MasterList=random_split_list_3.ListA, Seed=alternatives_for_residential_space_distr_2, Split=division_3)  # -> ListA, ListB
brep_4 = Brep(random_split_list_3.ListB)
brep_5 = Brep(random_split_list_4.ListB)
brep_6 = Brep(random_split_list_4.ListA)

# ---- group: Floor Generation (continued)
bb_section = BBSection(Mesh=brep_6, Planes=xy_plane, Thickness=0, Deeper=0)
residential_floors = BBSection(Mesh=brep_5, Planes=xy_plane, Thickness=0, Deeper=0)
commercial_floors = BBSection(Mesh=brep_4, Planes=xy_plane, Thickness=0, Deeper=0)
area_3 = Area(Geometry=bb_section)  # -> Area, Centroid
area_4 = Area(Geometry=residential_floors)  # -> Area, Centroid
area_5 = Area(Geometry=commercial_floors)  # -> Area, Centroid

# ----
merge = Merge(Data1=commercial_floors, Data2=residential_floors, Data3=bb_section)
custom_preview_lineweights_3 = CustomPreviewLineweights(Geometry=merge, Shader=ColourSwatch(SwatchColor=RGB(0, 0, 0)), Thickness=1, Absolute=False)
mesh_6 = Mesh(brep_4)
mesh_7 = Mesh(brep_6)
mesh_8 = Mesh(brep_5)

custom_preview_5 = CustomPreview(Geometry=mesh_8, Material=ColourSwatch(SwatchColor=RGB(246, 238, 64)))
custom_preview_6 = CustomPreview(Geometry=mesh_7, Material=ColourSwatch(SwatchColor=RGB(247, 157, 64)))
custom_preview_7 = CustomPreview(Geometry=mesh_6, Material=ColourSwatch(SwatchColor=RGB(45, 83, 255)))

context_bake_6 = ContextBake(CommercialBuildings=mesh_6)
context_bake_7 = ContextBake(MixedUseBuildings=mesh_7)
context_bake_8 = ContextBake(ResidentialBuildings=mesh_8)
brep_edges = BrepEdges(Brep=[brep_4, brep_5, brep_6])  # -> Naked, Interior, NonManifold
custom_preview_lineweights_4 = CustomPreviewLineweights(Geometry=brep_edges.Interior, Shader=ColourSwatch(SwatchColor=RGB(0, 0, 0)), Thickness=1, Absolute=False)

# ---- group: Area Calculation
area_6 = Area(Geometry=plots)  # -> Area, Centroid
clean_tree = CleanTree(RemoveNulls=True, RemoveInvalid=True, RemoveEmpty=False, Tree=area_5.Area)  # -> flatten(Tree)
boundary_surfaces_3 = BoundarySurfaces(Edges=site_boundary)
area_7 = Area(Geometry=brep_3)  # -> Area, Centroid
area_8 = Area(Geometry=trim_solid)  # -> Area, Centroid
area_9 = Area(Geometry=brep_2)  # -> Area, Centroid
clean_tree_2 = CleanTree(RemoveNulls=True, RemoveInvalid=True, RemoveEmpty=False, Tree=area_6.Area)
mass_addition_3 = MassAddition(Input=clean_tree)  # -> Result, PartialResults
area_10 = Area(Geometry=boundary_surfaces_3)  # -> Area, Centroid
clean_tree_3 = CleanTree(RemoveNulls=True, RemoveInvalid=True, RemoveEmpty=False, Tree=area_4.Area)  # -> flatten(Tree)
clean_tree_4 = CleanTree(RemoveNulls=True, RemoveInvalid=True, RemoveEmpty=False, Tree=area_3.Area)  # -> flatten(Tree)
clean_tree_5 = CleanTree(RemoveNulls=True, RemoveInvalid=True, RemoveEmpty=False, Tree=area_7.Area)  # -> flatten(Tree)
clean_tree_6 = CleanTree(RemoveNulls=True, RemoveInvalid=True, RemoveEmpty=False, Tree=area_8.Area)  # -> flatten(Tree)
clean_tree_7 = CleanTree(RemoveNulls=True, RemoveInvalid=True, RemoveEmpty=False, Tree=area_9.Area)  # -> flatten(Tree)
mass_addition_4 = MassAddition(Input=clean_tree_2)  # -> flatten(Result), PartialResults
division_6 = Division(A=area_10.Area, B=10000)
round_to_decimal_place = RoundToDecimalPlace(NumberX=mass_addition_3.Result, DecimalPlace=0, RoundType=0)  # -> Rounded, Difference
mass_addition_5 = MassAddition(Input=clean_tree_3)  # -> Result, PartialResults
mass_addition_6 = MassAddition(Input=clean_tree_4)  # -> Result, PartialResults
round_to_decimal_place_2 = RoundToDecimalPlace(NumberX=mass_addition_5.Result, DecimalPlace=0, RoundType=0)  # -> Rounded, Difference
round_to_decimal_place_3 = RoundToDecimalPlace(NumberX=clean_tree_6, DecimalPlace=0, RoundType=0)  # -> Rounded, Difference
mass_addition_7 = MassAddition(Input=clean_tree_7)  # -> Result, PartialResults
mass_addition_8 = MassAddition(Input=clean_tree_5)  # -> Result, PartialResults
round_to_decimal_place_4 = RoundToDecimalPlace(NumberX=mass_addition_6.Result, DecimalPlace=0, RoundType=0)  # -> Rounded, Difference
multiplication_5 = Multiplication(A=division_6, B=150)
total_commercial_space_area = Panel(round_to_decimal_place.Rounded)
residential_space_area = Panel(clean_tree_3)
commercial_space_area = Panel(clean_tree)
mixed_use_space_area = Panel(clean_tree_4)
amenity_space_area = Panel(clean_tree_5)
road_area = Panel(round_to_decimal_place_3.Rounded)
total_residential_space_area = Panel(round_to_decimal_place_2.Rounded)
number_of_trees_to_be_planted = Panel(multiplication_5)
total_amenity_space_area = Panel(mass_addition_8.Result)
total_site_area = Panel(area_10.Area)
open_space_area = Panel(clean_tree_7)
total_open_space_area = Panel(mass_addition_7.Result)
plot_area = Panel(clean_tree_2)
total_sellable_plot_area = Panel(mass_addition_4.Result)
total_mixed_use_space_area = Panel(round_to_decimal_place_4.Rounded)
text_5 = Text("sq.m.")
text_6 = Text("sq.m.")
text_7 = Text("sq.m.")
mass_addition_9 = MassAddition(Input=[mass_addition_3.Result, mass_addition_5.Result, mass_addition_6.Result])  # -> Result, PartialResults
round_to_decimal_place_5 = RoundToDecimalPlace(NumberX=area_10.Area, DecimalPlace=0, RoundType=0)  # -> Rounded, Difference
round_to_decimal_place_6 = RoundToDecimalPlace(NumberX=mass_addition_8.Result, DecimalPlace=0, RoundType=0)  # -> Rounded, Difference
round_to_decimal_place_7 = RoundToDecimalPlace(NumberX=mass_addition_7.Result, DecimalPlace=0, RoundType=0)  # -> Rounded, Difference
round_to_decimal_place_8 = RoundToDecimalPlace(NumberX=total_sellable_plot_area, DecimalPlace=0, RoundType=0)  # -> Rounded, Difference
concatenate_7 = Concatenate(FragmentA=round_to_decimal_place.Rounded, FragmentB=text_5)
concatenate_8 = Concatenate(FragmentA=round_to_decimal_place_4.Rounded, FragmentB=text_6)
concatenate_9 = Concatenate(FragmentA=round_to_decimal_place_2.Rounded, FragmentB=text_7)
text_8 = Text("sq.m.")
round_to_decimal_place_9 = RoundToDecimalPlace(NumberX=mass_addition_9.Result, DecimalPlace=0, RoundType=0)  # -> Rounded, Difference
text_9 = Text("sq.m.")
text_10 = Text("sq.m.")
text_11 = Text("sq.m.")
text_12 = Text("sq.m.")
total_mixed_use_space_area_2 = Panel(concatenate_8)
concatenate_10 = Concatenate(FragmentA=road_area, FragmentB=text_8)
total_residential_space_area_2 = Panel(concatenate_9)
total_commercial_space_area_2 = Panel(concatenate_7)
concatenate_11 = Concatenate(FragmentA=round_to_decimal_place_5.Rounded, FragmentB=text_9)
concatenate_12 = Concatenate(FragmentA=round_to_decimal_place_6.Rounded, FragmentB=text_10)
concatenate_13 = Concatenate(FragmentA=round_to_decimal_place_7.Rounded, FragmentB=text_11)
concatenate_14 = Concatenate(FragmentA=round_to_decimal_place_8.Rounded, FragmentB=text_12)
total_developable_area = Panel(round_to_decimal_place_9.Rounded)
road_area_2 = Panel(concatenate_10)
total_amenity_space_area_2 = Panel(concatenate_12)
total_site_area_2 = Panel(concatenate_11)
total_open_space_area_2 = Panel(concatenate_13)
total_sellable_plot_area_2 = Panel(concatenate_14)
text_13 = Text("sq.m.")
concatenate_15 = Concatenate(FragmentA=round_to_decimal_place_9.Rounded, FragmentB=text_13)
multiplication_6 = Multiplication(A=round_to_decimal_place_5.Rounded, B=0.000247105)
text_14 = Text(" Acre")
round_to_decimal_place_10 = RoundToDecimalPlace(NumberX=multiplication_6, DecimalPlace=0, RoundType=0)  # -> Rounded, Difference
total_developable_area_2 = Panel(concatenate_15)
concatenate_16 = Concatenate(FragmentA=round_to_decimal_place_10.Rounded, FragmentB=text_14)
total_site_area_3 = Panel(concatenate_16)

# ---- group: Cost Calculation
multiplication_7 = Multiplication(A=765, B=10.7639)
multiplication_8 = Multiplication(A=5, B=10.7639, C=round_to_decimal_place_3.Rounded)
multiplication_9 = Multiplication(A=2000, B=10.7639, C=round_to_decimal_place_9.Rounded)
division_7 = Division(A=multiplication_8, B=10000000)
division_8 = Division(A=multiplication_9, B=10000000)
multiplication_10 = Multiplication(A=round_to_decimal_place_5.Rounded, B=multiplication_7)
round_to_decimal_place_11 = RoundToDecimalPlace(NumberX=division_7, DecimalPlace=1, RoundType=0)  # -> Rounded, Difference
round_to_decimal_place_12 = RoundToDecimalPlace(NumberX=division_8, DecimalPlace=1, RoundType=0)  # -> Rounded, Difference
division_9 = Division(A=multiplication_10, B=10000000)
round = Round(Number=division_9)  # -> Nearest, Floor, Ceiling
python_3_script = Python3Script(x=round_to_decimal_place_11.Rounded)  # -> out, a
# ---------- python_3_script: Python ----------
input_number = x
out=str(x)
a=out
# ---------- end python_3_script ----------
text_15 = Text("Cr.")
python_3_script_2 = Python3Script(x=round_to_decimal_place_12.Rounded)  # -> out, a; same code as python_3_script
text_16 = Text("Cr.")
text_17 = Text("Cr.")
concatenate_17 = Concatenate(FragmentA=python_3_script.a, FragmentB=text_15)
concatenate_18 = Concatenate(FragmentA=python_3_script_2.a, FragmentB=text_16)
python_3_script_3 = Python3Script(x=round.Nearest)  # -> out, a; same code as python_3_script
mass_addition_10 = MassAddition(Input=[python_3_script_3.a, python_3_script_2.a, python_3_script.a])  # -> Result, PartialResults
concatenate_19 = Concatenate(FragmentA=mass_addition_10.Result, FragmentB=text_17)
text_18 = Text("Cr.")
road_cost = Panel(concatenate_17)
total_cost = Panel(concatenate_19)
construction_cost = Panel(concatenate_18)
concatenate_20 = Concatenate(FragmentA=python_3_script_3.a, FragmentB=text_18)
land_cost = Panel(concatenate_20)

# ----
total_cost_2 = Number(mass_addition_10.Result)
percentage = Percentage(Number=clean_tree_4, Percent=80)
percentage_2 = Percentage(Number=clean_tree_4, Percent=20)
multiplication_11 = Multiplication(A=clean_tree, B=multiplication_3)
multiplication_12 = Multiplication(A=clean_tree_3, B=multiplication_4)
multiplication_13 = Multiplication(A=mass_addition_5.Result, B=multiplication_4)
percentage_3 = Percentage(Number=mass_addition_6.Result, Percent=80)
multiplication_14 = Multiplication(A=mass_addition_3.Result, B=multiplication_3)
percentage_4 = Percentage(Number=mass_addition_6.Result, Percent=20)
multiplication_15 = Multiplication(A=total_sellable_plot_area, B=multiplication)
multiplication_16 = Multiplication(A=plot_area, B=multiplication_2)
round_2 = Round(Number=multiplication_12)  # -> Nearest, Floor, Ceiling
round_3 = Round(Number=multiplication_11)  # -> Nearest, Floor, Ceiling
multiplication_17 = Multiplication(A=percentage, B=multiplication_4)
multiplication_18 = Multiplication(A=percentage_2, B=multiplication_3)
round_to_decimal_place_13 = RoundToDecimalPlace(NumberX=multiplication_13, DecimalPlace=0, RoundType=0)  # -> Rounded, Difference
round_to_decimal_place_14 = RoundToDecimalPlace(NumberX=multiplication_14, DecimalPlace=0, RoundType=0)  # -> Rounded, Difference
multiplication_19 = Multiplication(A=percentage_4, B=multiplication_3)
multiplication_20 = Multiplication(A=percentage_3, B=multiplication_4)
round_4 = Round(Number=multiplication_15)  # -> Nearest, Floor, Ceiling
round_5 = Round(Number=multiplication_16)  # -> Nearest, Floor, Ceiling
mass_addition_11 = MassAddition(Input=[multiplication_19, multiplication_20])  # -> Result, PartialResults
addition_2 = Addition(A=multiplication_18, B=multiplication_17)
round_to_decimal_place_15 = RoundToDecimalPlace(NumberX=addition_2, DecimalPlace=0, RoundType=0)  # -> Rounded, Difference
round_to_decimal_place_16 = RoundToDecimalPlace(NumberX=mass_addition_11.Result, DecimalPlace=0, RoundType=0)  # -> Rounded, Difference
python_3_script_4 = Python3Script(x=round_to_decimal_place_13.Rounded)  # -> out, a; same code as python_3_script
python_3_script_5 = Python3Script(x=round_2.Nearest)  # -> out, a; same code as python_3_script
python_3_script_6 = Python3Script(x=round_to_decimal_place_14.Rounded)  # -> out, a; same code as python_3_script
python_3_script_7 = Python3Script(x=round_3.Nearest)  # -> out, a; same code as python_3_script
python_3_script_8 = Python3Script(x=round_to_decimal_place_15.Rounded)  # -> out, a; same code as python_3_script
python_3_script_9 = Python3Script(x=round_to_decimal_place_16.Rounded)  # -> out, a; same code as python_3_script
python_3_script_10 = Python3Script(x=round_4.Nearest)  # -> out, a; same code as python_3_script
python_3_script_11 = Python3Script(x=round_5.Nearest)  # -> out, a; same code as python_3_script
market_price_of_commercial_space = Panel(python_3_script_7.a)
total_market_price_of_commercial_space = Panel(python_3_script_6.a)
market_price_of_mixed_use_space = Panel(python_3_script_8.a)
total_market_price_of_residential_space = Panel(python_3_script_4.a)
total_market_price_of_mixed_use_space = Panel(python_3_script_9.a)
market_price_of_residential_space = Panel(python_3_script_5.a)
market_price_of_plots = Panel(python_3_script_11.a)
market_price_of_plots_2 = Panel(python_3_script_10.a)
mass_addition_12 = MassAddition(Input=[round_to_decimal_place_14.Rounded, round_to_decimal_place_13.Rounded, round_to_decimal_place_16.Rounded])  # -> Result, PartialResults
division_10 = Division(A=python_3_script_6.a, B=10000000)
division_11 = Division(A=python_3_script_4.a, B=10000000)
division_12 = Division(A=python_3_script_9.a, B=10000000)
round_to_decimal_place_17 = RoundToDecimalPlace(NumberX=mass_addition_12.Result, DecimalPlace=0, RoundType=0)  # -> Rounded, Difference
round_to_decimal_place_18 = RoundToDecimalPlace(NumberX=division_10, DecimalPlace=1, RoundType=0)  # -> Rounded, Difference
round_to_decimal_place_19 = RoundToDecimalPlace(NumberX=division_11, DecimalPlace=0, RoundType=0)  # -> Rounded, Difference
round_to_decimal_place_20 = RoundToDecimalPlace(NumberX=division_12, DecimalPlace=0, RoundType=0)  # -> Rounded, Difference
python_3_script_12 = Python3Script(x=round_to_decimal_place_17.Rounded)  # -> out, a; same code as python_3_script
concatenate_21 = Concatenate(FragmentA=round_to_decimal_place_19.Rounded, FragmentB=text_2)
concatenate_22 = Concatenate(FragmentA=round_to_decimal_place_18.Rounded, FragmentB=text)
concatenate_23 = Concatenate(FragmentA=round_to_decimal_place_20.Rounded, FragmentB=text_3)
total_market_price_of_development = Panel(python_3_script_12.a)
total_market_price_of_commercial_space_2 = Panel(concatenate_22)
total_market_price_of_residential_space_2 = Panel(concatenate_21)
total_market_price_of_mixed_use_space_2 = Panel(concatenate_23)
division_13 = Division(A=python_3_script_12.a, B=10000000)
round_to_decimal_place_21 = RoundToDecimalPlace(NumberX=division_13, DecimalPlace=0, RoundType=0)  # -> Rounded, Difference
total_market_price = Number(round_to_decimal_place_21.Rounded)
subtraction_2 = Subtraction(A=total_market_price, B=total_cost_2)
capital_gain = Number(subtraction_2)
division_14 = Division(A=capital_gain, B=total_cost_2)
multiplication_21 = Multiplication(A=division_14, B=100)
round_to_decimal_place_22 = RoundToDecimalPlace(NumberX=multiplication_21, DecimalPlace=1, RoundType=0)  # -> Rounded, Difference
concatenate_24 = Concatenate(FragmentA=round_to_decimal_place_22.Rounded, FragmentB="%")
roi = Panel(concatenate_24)
concatenate_25 = Concatenate(FragmentA=round_to_decimal_place_21.Rounded, FragmentB=text_4)
total_market_price_of_development_2 = Panel(concatenate_25)

# ---- group: output
curve_2 = Curve(<curve referenced from the Rhino model>)
divide_curve = DivideCurve(Curve=curve_2, Count=10, Kinks=False)  # -> reverse(Points), Tangents, Parameters
list_item = ListItem(List=divide_curve.Points, Index=0, Wrap=True)
list_item_2 = ListItem(List=divide_curve.Points, Index=3, Wrap=True)
list_item_3 = ListItem(List=divide_curve.Points, Index=6, Wrap=True)
list_item_4 = ListItem(List=divide_curve.Points, Index=9, Wrap=True)
list_item_5 = ListItem(List=divide_curve.Points, Index=8, Wrap=True)
list_item_6 = ListItem(List=divide_curve.Points, Index=5, Wrap=True)
list_item_7 = ListItem(List=divide_curve.Points, Index=2, Wrap=True)
list_item_8 = ListItem(List=divide_curve.Points, Index=7, Wrap=True)
list_item_9 = ListItem(List=divide_curve.Points, Index=1, Wrap=True)
list_item_10 = ListItem(List=divide_curve.Points, Index=4, Wrap=True)
geometry_2 = Geometry(list_item)
geometry_3 = Geometry(list_item_2)
geometry_4 = Geometry(list_item_3)
geometry_5 = Geometry(list_item_6)
geometry_6 = Geometry(list_item_4)
geometry_7 = Geometry(list_item_5)
geometry_8 = Geometry(list_item_7)
geometry_9 = Geometry(list_item_8)
number_slider = Slider(834, range=100..1000)  # disabled
geometry_10 = Geometry(list_item_10)
geometry_11 = Geometry(list_item_9)
unit_z_4 = UnitZ(Factor=1)  # disabled
text_19 = Text("Site Area ")
text_20 = Text(concatenate_16)
text_21 = Text("Road Cost ")
text_22 = Text(concatenate_17)
text_23 = Text("Total Cost ")
text_24 = Text("ROI ")
text_25 = Text(concatenate_24)
text_26 = Text(concatenate_19)
text_27 = Text("Commercial Space")
text_28 = Text("Construction Cost ")
text_29 = Text(concatenate_18)
text_30 = Text("Market Price ")
text_31 = Text("Land Cost ")
point = Point(Point(149.3842346, -246.6878816, 0))  # disabled
text_32 = Text(concatenate_25)
text_33 = Text(concatenate_20)
text_34 = Text(concatenate_22)
text_35 = Text("Mixed-Use Space")
text_36 = Text(concatenate_23)
text_37 = Text("Residential Space ")
text_38 = Text(concatenate_21)
concatenate_26 = Concatenate(FragmentA=text_19, FragmentB=text_20)
concatenate_27 = Concatenate(FragmentA=text_21, FragmentB=text_22)
colour_swatch = ColourSwatch(SwatchColor=RGB(255, 255, 255))
concatenate_28 = Concatenate(FragmentA=text_24, FragmentB=text_25)
concatenate_29 = Concatenate(FragmentA=text_23, FragmentB=text_26)
concatenate_30 = Concatenate(FragmentA=text_28, FragmentB=text_29)
concatenate_31 = Concatenate(FragmentA=text_30, FragmentB=text_32)
concatenate_32 = Concatenate(FragmentA=text_31, FragmentB=text_33)
colour_swatch_2 = ColourSwatch(SwatchColor=RGB(255, 255, 255))
concatenate_33 = Concatenate(FragmentA=text_27, FragmentB=text_34)
concatenate_34 = Concatenate(FragmentA=text_35, FragmentB=text_36)
concatenate_35 = Concatenate(FragmentA=text_37, FragmentB=text_38)
line_sdl = LineSDL(Start=point, Direction=unit_z_4, Length=number_slider)  # disabled
text_tag = TextTag(Location=geometry_6, Text=concatenate_27, Colour=colour_swatch)
text_tag_2 = TextTag(Location=geometry_11, Text=concatenate_28, Colour=colour_swatch)
text_tag_3 = TextTag(Location=geometry_4, Text=concatenate_29, Colour=colour_swatch)
text_tag_4 = TextTag(Location=geometry_7, Text=concatenate_30, Colour=colour_swatch)
text_tag_5 = TextTag(Location=geometry_2, Text=concatenate_26, Colour=colour_swatch)
text_tag_6 = TextTag(Location=geometry_8, Text=concatenate_31, Colour=colour_swatch)
text_tag_7 = TextTag(Location=geometry_9, Text=concatenate_32, Colour=colour_swatch)
text_tag_8 = TextTag(Location=geometry_10, Text=concatenate_35, Colour=colour_swatch_2)
text_tag_9 = TextTag(Location=geometry_3, CommercialSpace=concatenate_33, Colour=colour_swatch_2)
text_tag_10 = TextTag(Location=geometry_5, Text=concatenate_34, Colour=colour_swatch_2)
curve_3 = Curve(<curve referenced from the Rhino model>)
divide_curve_2 = DivideCurve(Curve=curve_3, Count=9, Kinks=False)  # -> reverse(Points), Tangents, Parameters
list_item_11 = ListItem(List=divide_curve_2.Points, Index=1, Wrap=True)
list_item_12 = ListItem(List=divide_curve_2.Points, Index=8, Wrap=True)
list_item_13 = ListItem(List=divide_curve_2.Points, Index=2, Wrap=True)
list_item_14 = ListItem(List=divide_curve_2.Points, Index=0, Wrap=True)
list_item_15 = ListItem(List=divide_curve_2.Points, Index=6, Wrap=True)
list_item_16 = ListItem(List=divide_curve_2.Points, Index=7, Wrap=True)
list_item_17 = ListItem(List=divide_curve_2.Points, Index=5, Wrap=True)
list_item_18 = ListItem(List=divide_curve_2.Points, Index=3, Wrap=True)
list_item_19 = ListItem(List=divide_curve_2.Points, Index=4, Wrap=True)
geometry_12 = Geometry(list_item_11)
geometry_13 = Geometry(list_item_13)
geometry_14 = Geometry(list_item_12)
geometry_15 = Geometry(list_item_14)
geometry_16 = Geometry(list_item_15)
geometry_17 = Geometry(list_item_16)
geometry_18 = Geometry(list_item_17)
geometry_19 = Geometry(list_item_18)
geometry_20 = Geometry(list_item_19)
text_39 = Text("Road Area ")
text_40 = Text("Developable Area ")
sellable_plot_area = Text("Sellable Plot Area ")
text_41 = Text(concatenate_10)
text_42 = Text(concatenate_15)
text_43 = Text("Trees to be planted min. ")
text_44 = Text(multiplication_5)
text_45 = Text(concatenate_14)
text_46 = Text("Amenity Space ")
text_47 = Text("Open Space ")
text_48 = Text(concatenate_12)
text_49 = Text(concatenate_13)
text_50 = Text("Mixed-Use Space ")
text_51 = Text(concatenate_7)
text_52 = Text(concatenate_9)
text_53 = Text(concatenate_8)
text_54 = Text("Commercial Space")
text_55 = Text("Residential Space ")
concatenate_36 = Concatenate(FragmentA=text_39, FragmentB=text_41)
concatenate_37 = Concatenate(FragmentA=text_43, FragmentB=text_44)
concatenate_38 = Concatenate(Fragment_A=text_46, Fragment_B=text_48, A=concatenate_3)
concatenate_39 = Concatenate(Fragment_A=text_47, Fragment_B=text_49, A=concatenate)
concatenate_40 = Concatenate(FragmentA=sellable_plot_area, FragmentB=text_45)
concatenate_41 = Concatenate(Fragment_A=text_50, Fragment_B=text_53, A=concatenate_5)
concatenate_42 = Concatenate(Fragment_A=text_54, Fragment_B=text_51, A=concatenate_4)
concatenate_43 = Concatenate(Fragment_A=text_55, Fragment_B=text_52, A=concatenate_2)
concatenate_44 = Concatenate(FragmentA=text_40, FragmentB=text_42)
text_tag_11 = TextTag(Location=geometry_12, Text=concatenate_36, Colour=colour_swatch)
text_tag_12 = TextTag(Location=geometry_14, Text=concatenate_37, Colour=colour_swatch)
text_tag_13 = TextTag(Location=geometry_13, Text=concatenate_44, Colour=colour_swatch)
text_tag_14 = TextTag(Location=geometry_16, Text=concatenate_38, Colour=colour_swatch)
text_tag_15 = TextTag(Location=geometry_17, Text=concatenate_39, Colour=colour_swatch)
text_tag_16 = TextTag(Location=geometry_15, Text=concatenate_40, Colour=colour_swatch)
text_tag_17 = TextTag(Location=geometry_18, Text=concatenate_41, Colour=colour_swatch)
text_tag_18 = TextTag(Location=geometry_19, Text=concatenate_42, Colour=colour_swatch)
text_tag_19 = TextTag(Location=geometry_20, Text=concatenate_43, Colour=colour_swatch)

# ----
context_bake_9 = ContextBake(ConstructionCost=concatenate_30)
context_bake_10 = ContextBake(RoadCost=concatenate_27)
context_bake_11 = ContextBake(LandCost=concatenate_32)
context_bake_12 = ContextBake(SiteArea=concatenate_26)
context_bake_13 = ContextBake(MarketPrice=concatenate_31)
context_bake_14 = ContextBake(ResidentialSpace=concatenate_35)
context_bake_15 = ContextBake(Content=concatenate_28)
context_bake_16 = ContextBake(TotalCost=concatenate_29)
context_bake_17 = ContextBake(CommercialSpace=concatenate_33)
context_bake_18 = ContextBake(MixedUseSpace=concatenate_34)
context_bake_19 = ContextBake(AmenitySpace=concatenate_38)
context_bake_20 = ContextBake(OpenSpace=concatenate_39)
context_bake_21 = ContextBake(RoadArea=concatenate_36)
context_bake_22 = ContextBake(TreesToBePlantedMin=concatenate_37)
context_bake_23 = ContextBake(DevelopableArea=concatenate_44)
context_bake_24 = ContextBake(MixedUseSpace=concatenate_41)
context_bake_25 = ContextBake(CommercialSpace=concatenate_42)
context_bake_26 = ContextBake(SellablePlotArea=concatenate_40)
context_bake_27 = ContextBake(ResidentialSpace=concatenate_43)

# ==== cluster CustomEdgeWeights: Creates lits for custom edge weighting. Each line segment can be assigned either custom or general weight. segments with custom weights are identifyied via custom weight point list
segments = ClusterInput()
pointsofinterest = ClusterInput()
customweights = ClusterInput()
generalweight = ClusterInput()
segments_2 = Line(segments)
generalweight_2 = Number(generalweight)
customweights_2 = Number(customweights)
pointsofinterest_2 = Point(pointsofinterest)
lng = ListLength(List=segments_2)
crv_cp = CurveClosestPoint(Point=graft(pointsofinterest_2), Curve=segments_2)  # -> Point, Parameter, Distance
series = Series(Start=0, Step=1, Count=lng)
sort = SortList(Keys=crv_cp.Distance, ValuesA=series)  # -> Keys, ValuesA
item = ListItem(List=sort.ValuesA, Index=0, Wrap=True)  # -> flatten(Item)
lng_2 = ListLength(List=item)
dup = DuplicateData(Data=customweights_2, Number=lng_2, Order=True)
c_script = CSharpScript(x=customweights_2, y=dup)  # -> out, A; inputs x: list of Double, y: list of Double
# ---------- c_script: C# usings ----------
using System.IO;
using System.Linq;
using System.Data;
using System.Drawing;
using System.Reflection;
using System.Windows.Forms;
using System.Xml;
using System.Xml.Linq;
using System.Runtime.InteropServices;

using Rhino.DocObjects;
using Rhino.Collections;
using GH_IO;
using GH_IO.Serialization;
# ---------- c_script: C# ----------
    if(x.Count == 1)
      A = y;
    else
      A = x;
# ---------- end c_script ----------
ids = Integer(item)
c_list = CSharpScript(edge_count=lng, ids=ids, weights=c_script.A, general_weight=generalweight_2)  # -> add_weight; inputs edge_count: Int32, ids: list of Int32, weights: list of Double, general_weight: Double
# ---------- c_list: C# ----------
    List<double> result = new List<double>(); //Enumerable.Repeat(general_weight, edge_count).ToList();

    for (int i = 0; i < edge_count * 2; i++)
    {
      result.Add(general_weight);
    }


    for (int i = 0; i < ids.Count; i++)
    {
      result[ids[i]*2] = weights[i];
      result[ids[i]*2 + 1] = weights[i];
    }

    add_weight = result;
# ---------- end c_list ----------
weight_list = Number(c_list)
weight_list_2 = ClusterOutput(weight_list)
