# Grasshopper definition temp.gh (Grasshopper 1.0.7)

number = GetNumber(Slider(4, range=0..10), AtLeast=1, AtMost=1, Maximum=1.797693135e+308, Minimum=-1.797693135e+308, TreeAccess=False)
msphereex = MeshSphereEx(Base=PlaneXY(0, 0, 0), Radius=number, Count=5)
mesh = Mesh(msphereex)
context_print = ContextPrint(Text=mesh)
context_print_2 = ContextPrint()
context_print_3 = ContextPrint()
context_print_4 = ContextPrint()
