# Grasshopper definition value_list2.gh (Grasshopper 1.0.7)

list = ValueList({"One": 1, "Two": 2, "Three": 2² - 1, "Four": Sqrt(16)}, selected="One")

# ---- group: RH_IN:number
int = Integer(list)

# ----
series = Series(Start=0, Step=1, Count=int)
multiplication = Multiplication(A=series, B=Slider(100, range=0..100))
msphere = MeshSphere(Base=PlaneXY(0, 0, 0), Radius=10, UCount=10, VCount=20)
X = UnitX(Factor=multiplication)
move = Move(Geometry=msphere, Motion=X)  # -> Geometry, Transform

# ---- group: RH_OUT:spheres
mesh = Mesh(move.Geometry)
